# Dynamo graph AutoRename Openings V 1.9 .dyn "Auto Rename V 1.9" (Dynamo 2.16.2.5624)
# author: Yousef Altear
# Auto Renaming of Doors , Windows ,Roof Cuts ,Ceiling Cuts and Stone Wall
# packages: Clockwork for Dynamo 2.x 2.6.0, ParadigmPackage 0.0.1, spring nodes 210.1.1, Rhythm 2023.9.1

# group: Auto Rename v 1.9
# note: Ⓒ Copyright of Script to Paragons Egypt Team

# group: Door Control
categories = Categories("OST_Doors")
all_family_types_of_category = Custom[All Family Types Of Category](category=categories)  # package Clockwork for Dynamo 2.x; Gets all family types/symbols of a given category in the model.
name = Element.Name(element=all_family_types_of_category)
number_slider = DoubleSlider(0, range=0..10 step 1)
number_slider_2 = DoubleSlider(4, range=0..10 step 1)
substring = String.Substring(string=name, startIndex=number_slider, length=number_slider_2)
code_block = CodeBlock { "Main"; }
eq = substring == code_block
filterByBoolMask = List.FilterByBoolMask(list=all_family_types_of_category, mask=eq)
name_2 = Element.Name(element=filterByBoolMask.out)
number_slider_3 = DoubleSlider(0, range=0..10 step 1)
number_slider_4 = DoubleSlider(4, range=0..10 step 1)
substring_2 = String.Substring(string=name_2, startIndex=number_slider_3, length=number_slider_4)
code_block_2 = CodeBlock { "Seco"; }
eq_2 = substring_2 == code_block_2
filterByBoolMask_2 = List.FilterByBoolMask(list=filterByBoolMask.out, mask=eq_2)

# group: Width
code_block_3 = CodeBlock { "Width"; }
ʳʰʸᵗʰᵐ_elements = Rhythm.Revit.Elements.Elements.GetParameterValueByNameTypeOrInstance(element=filterByBoolMask_2.out, parameterName=code_block_3)
number_slider_5 = DoubleSlider(2, range=0..100 step 1)
round = Math.Round(number=ʳʰʸᵗʰᵐ_elements, digits=number_slider_5)
ꟿ_feet_tofraction = Custom[ꟿ Feet.ToFraction](number=round)  # package spring nodes; Converts a decimal foot value to a fractional foot/inch string.
autoRename = Custom[AutoRename](list=ꟿ_feet_tofraction)  # package ParadigmPackage; Renaming of openings in Projects

# group: Height
code_block_4 = CodeBlock { "Height"; }
ʳʰʸᵗʰᵐ_elements_2 = Rhythm.Revit.Elements.Elements.GetParameterValueByNameTypeOrInstance(element=filterByBoolMask_2.out, parameterName=code_block_4)
number_slider_6 = DoubleSlider(2, range=0..100 step 1)
round_2 = Math.Round(number=ʳʰʸᵗʰᵐ_elements_2, digits=number_slider_6)
ꟿ_feet_tofraction_2 = Custom[ꟿ Feet.ToFraction](number=round_2)
autoRename_2 = Custom[AutoRename](list=ꟿ_feet_tofraction_2)

# group: Interior Door
add = autoRename + autoRename_2
code_block_5 = CodeBlock { " "; }
string = StringInput("")
replace = String.Replace(string=add, searchFor=code_block_5, replaceWith=string)
code_block_6 = CodeBlock { 0; }
door_window_location = CustomSelection("Interior", items={Main: "Main - ", Secondary: "Secondary - ", Interior: ""})
insert = String.Insert(string=replace, index=code_block_6, toInsert=door_window_location)

# group: Interior Doors Rename
name_3 = Element.Name(element=filterByBoolMask_2.out)
replace_2 = String.Replace(string=name_3, searchFor=name_3, replaceWith=insert)
flatten = List.Flatten(list=replace_2)
setName = Custom[Element.SetName](element=filterByBoolMask_2.out, name=flatten)  # package Clockwork for Dynamo 2.x; Gets the name of a given Revit element

# group: Width
code_block_7 = CodeBlock { "Width"; }
ʳʰʸᵗʰᵐ_elements_3 = Rhythm.Revit.Elements.Elements.GetParameterValueByNameTypeOrInstance(element=filterByBoolMask_2.in, parameterName=code_block_7)
number_slider_7 = DoubleSlider(2, range=0..100 step 1)
round_3 = Math.Round(number=ʳʰʸᵗʰᵐ_elements_3, digits=number_slider_7)
ꟿ_feet_tofraction_3 = Custom[ꟿ Feet.ToFraction](number=round_3)
autoRename_3 = Custom[AutoRename](list=ꟿ_feet_tofraction_3)

# group: Height
code_block_8 = CodeBlock { "Height"; }
ʳʰʸᵗʰᵐ_elements_4 = Rhythm.Revit.Elements.Elements.GetParameterValueByNameTypeOrInstance(element=filterByBoolMask_2.in, parameterName=code_block_8)
number_slider_8 = DoubleSlider(2, range=0..100 step 1)
round_4 = Math.Round(number=ʳʰʸᵗʰᵐ_elements_4, digits=number_slider_8)
ꟿ_feet_tofraction_4 = Custom[ꟿ Feet.ToFraction](number=round_4)
autoRename_4 = Custom[AutoRename](list=ꟿ_feet_tofraction_4)

# group: Secondry Doors
add_2 = autoRename_3 + autoRename_4
code_block_9 = CodeBlock { " "; }
string_2 = StringInput("")
replace_3 = String.Replace(string=add_2, searchFor=code_block_9, replaceWith=string_2)
code_block_10 = CodeBlock { 0; }
door_window_location_2 = CustomSelection("Secondary", items={Main: "Main - ", Secondary: "Secondary - ", Interior: ""})
insert_2 = String.Insert(string=replace_3, index=code_block_10, toInsert=door_window_location_2)

# group: Secondary Doors Rename
name_4 = Element.Name(element=filterByBoolMask_2.in)
replace_4 = String.Replace(string=name_4, searchFor=name_4, replaceWith=insert_2)
flatten_2 = List.Flatten(list=replace_4)
setName_2 = Custom[Element.SetName](element=filterByBoolMask_2.in, name=flatten_2)

# group: Width
code_block_11 = CodeBlock { "Width"; }
ʳʰʸᵗʰᵐ_elements_5 = Rhythm.Revit.Elements.Elements.GetParameterValueByNameTypeOrInstance(element=filterByBoolMask.in, parameterName=code_block_11)
number_slider_9 = DoubleSlider(2, range=0..100 step 1)
round_5 = Math.Round(number=ʳʰʸᵗʰᵐ_elements_5, digits=number_slider_9)
ꟿ_feet_tofraction_5 = Custom[ꟿ Feet.ToFraction](number=round_5)
autoRename_5 = Custom[AutoRename](list=ꟿ_feet_tofraction_5)

# group: Height
code_block_12 = CodeBlock { "Height"; }
ʳʰʸᵗʰᵐ_elements_6 = Rhythm.Revit.Elements.Elements.GetParameterValueByNameTypeOrInstance(element=filterByBoolMask.in, parameterName=code_block_12)
number_slider_10 = DoubleSlider(2, range=0..100 step 1)

round_6 = Math.Round(number=ʳʰʸᵗʰᵐ_elements_6, digits=number_slider_10)

# group (continued): Height
ꟿ_feet_tofraction_6 = Custom[ꟿ Feet.ToFraction](number=round_6)
autoRename_6 = Custom[AutoRename](list=ꟿ_feet_tofraction_6)

# group: Main Doors
add_3 = autoRename_5 + autoRename_6
code_block_13 = CodeBlock { " "; }
string_3 = StringInput("")
replace_5 = String.Replace(string=add_3, searchFor=code_block_13, replaceWith=string_3)
code_block_14 = CodeBlock { 0; }
door_window_location_3 = CustomSelection("Secondary", items={Main: "Main - ", Secondary: "Secondary - ", Interior: ""})
insert_3 = String.Insert(string=replace_5, index=code_block_14, toInsert=door_window_location_3)

# group: Secondary Doors Rename
name_5 = Element.Name(element=filterByBoolMask.in)
replace_6 = String.Replace(string=name_5, searchFor=name_5, replaceWith=insert_3)
flatten_3 = List.Flatten(list=replace_6)
setName_3 = Custom[Element.SetName](element=filterByBoolMask.in, name=flatten_3)

# group: Windows Control
categories_2 = Categories("OST_Windows")
all_family_types_of_category_2 = Custom[All Family Types Of Category](category=categories_2)
name_6 = Element.Name(element=all_family_types_of_category_2)
length = String.Length(string=name_6)
code_block_15 = CodeBlock { 4; }
eq_3 = length == code_block_15
filterByBoolMask_3 = List.FilterByBoolMask(list=all_family_types_of_category_2, mask=eq_3)
name_7 = Element.Name(element=filterByBoolMask_3.out)
length_2 = String.Length(string=name_7)
code_block_16 = CodeBlock { 9; }
eq_4 = length_2 == code_block_16
filterByBoolMask_4 = List.FilterByBoolMask(list=filterByBoolMask_3.out, mask=eq_4)
name_8 = Element.Name(element=filterByBoolMask_4.out)
number_slider_11 = DoubleSlider(0, range=0..10 step 1)
number_slider_12 = DoubleSlider(4, range=0..10 step 1)
substring_3 = String.Substring(string=name_8, startIndex=number_slider_11, length=number_slider_12)
code_block_17 = CodeBlock { "Main"; }
eq_5 = substring_3 == code_block_17
filterByBoolMask_5 = List.FilterByBoolMask(list=filterByBoolMask_4.out, mask=eq_5)

# group: Width
code_block_18 = CodeBlock { "Width"; }
ʳʰʸᵗʰᵐ_elements_7 = Rhythm.Revit.Elements.Elements.GetParameterValueByNameTypeOrInstance(element=filterByBoolMask_5.out, parameterName=code_block_18)
number_slider_13 = DoubleSlider(2, range=0..100 step 1)
round_7 = Math.Round(number=ʳʰʸᵗʰᵐ_elements_7, digits=number_slider_13)
ꟿ_feet_tofraction_7 = Custom[ꟿ Feet.ToFraction](number=round_7)
autoRename_7 = Custom[AutoRename](list=ꟿ_feet_tofraction_7)

# group: Height
code_block_19 = CodeBlock { "Height"; }
ʳʰʸᵗʰᵐ_elements_8 = Rhythm.Revit.Elements.Elements.GetParameterValueByNameTypeOrInstance(element=filterByBoolMask_5.out, parameterName=code_block_19)
number_slider_14 = DoubleSlider(2, range=0..100 step 1)
round_8 = Math.Round(number=ʳʰʸᵗʰᵐ_elements_8, digits=number_slider_14)
ꟿ_feet_tofraction_8 = Custom[ꟿ Feet.ToFraction](number=round_8)
autoRename_8 = Custom[AutoRename](list=ꟿ_feet_tofraction_8)

# group: Secondry Windows
add_4 = autoRename_7 + autoRename_8
code_block_20 = CodeBlock { " "; }
string_4 = StringInput("")
replace_7 = String.Replace(string=add_4, searchFor=code_block_20, replaceWith=string_4)
code_block_21 = CodeBlock { 0; }
door_window_location_4 = CustomSelection("Secondary", items={Main: "Main - ", Secondary: "Secondary - ", Interior: ""})
insert_4 = String.Insert(string=replace_7, index=code_block_21, toInsert=door_window_location_4)

# group: Secondary Windows Rename
name_9 = Element.Name(element=filterByBoolMask_5.out)
replace_8 = String.Replace(string=name_9, searchFor=name_9, replaceWith=insert_4)
flatten_4 = List.Flatten(list=replace_8)
setName_4 = Custom[Element.SetName](element=filterByBoolMask_5.out, name=flatten_4)

# group: Width
code_block_22 = CodeBlock { "Width"; }
ʳʰʸᵗʰᵐ_elements_9 = Rhythm.Revit.Elements.Elements.GetParameterValueByNameTypeOrInstance(element=filterByBoolMask_5.in, parameterName=code_block_22)
number_slider_15 = DoubleSlider(2, range=0..100 step 1)
round_9 = Math.Round(number=ʳʰʸᵗʰᵐ_elements_9, digits=number_slider_15)
ꟿ_feet_tofraction_9 = Custom[ꟿ Feet.ToFraction](number=round_9)
autoRename_9 = Custom[AutoRename](list=ꟿ_feet_tofraction_9)

# group: Height
code_block_23 = CodeBlock { "Height"; }
ʳʰʸᵗʰᵐ_elements_10 = Rhythm.Revit.Elements.Elements.GetParameterValueByNameTypeOrInstance(element=filterByBoolMask_5.in, parameterName=code_block_23)
number_slider_16 = DoubleSlider(2, range=0..100 step 1)
round_10 = Math.Round(number=ʳʰʸᵗʰᵐ_elements_10, digits=number_slider_16)
ꟿ_feet_tofraction_10 = Custom[ꟿ Feet.ToFraction](number=round_10)
autoRename_10 = Custom[AutoRename](list=ꟿ_feet_tofraction_10)

# group: Main Windows
add_5 = autoRename_9 + autoRename_10
code_block_24 = CodeBlock { " "; }
string_5 = StringInput("")
replace_9 = String.Replace(string=add_5, searchFor=code_block_24, replaceWith=string_5)
code_block_25 = CodeBlock { 0; }
door_window_location_5 = CustomSelection("Main", items={Main: "Main - ", Secondary: "Secondary - ", Interior: ""})
insert_5 = String.Insert(string=replace_9, index=code_block_25, toInsert=door_window_location_5)

# group: Secondary Windows Rename
name_10 = Element.Name(element=filterByBoolMask_5.in)
replace_10 = String.Replace(string=name_10, searchFor=name_10, replaceWith=insert_5)
flatten_5 = List.Flatten(list=replace_10)
setName_5 = Custom[Element.SetName](element=filterByBoolMask_5.in, name=flatten_5)
