# Dynamo custom node AutoRename.dyf (Dynamo 2.16.2.5624)
# category: MyPackage
# Auto Renaming of the Openings
# packages: spring nodes 210.1.1, Rhythm 2023.9.1

element = Input(element: Revit.Elements.Element)
parameterName = Input(parameterName: string)

# group: Control
ʳʰʸᵗʰᵐ_elements = Rhythm.Revit.Elements.Elements.GetParameterValueByNameTypeOrInstance(element=element, parameterName=parameterName)
ꟿ_feet_tofraction = Custom[ꟿ Feet.ToFraction](number=ʳʰʸᵗʰᵐ_elements)  # package spring nodes; Converts a decimal foot value to a fractional foot/inch string.
string = StringInput("\"")
boolean = BoolSelector(true)
contains = String.Contains(string=ꟿ_feet_tofraction, searchFor=string, ignoreCase=boolean)
filterByBoolMask = List.FilterByBoolMask(list=ꟿ_feet_tofraction, mask=contains)
string_2 = StringInput("/")
contains_2 = String.Contains(string=filterByBoolMask.in, searchFor=string_2)
filterByBoolMask_2 = List.FilterByBoolMask(list=filterByBoolMask.in, mask=contains_2)
string_3 = StringInput("'")
boolean_2 = BoolSelector(true)
contains_3 = String.Contains(string=filterByBoolMask_2.in, searchFor=string_3, ignoreCase=boolean_2)
filterByBoolMask_3 = List.FilterByBoolMask(list=filterByBoolMask_2.in, mask=contains_3)

# group: Single
length = String.Length(string=filterByBoolMask.out)
number = DoubleInput(2)
eq = length == number
filterByBoolMask_4 = List.FilterByBoolMask(list=filterByBoolMask.out, mask=eq)
list_create = List.Create(item0=filterByBoolMask_4.in)
code_block = CodeBlock { "    0"; }
add = list_create + code_block
list_create_2 = List.Create(item0=filterByBoolMask_4.out)
code_block_2 = CodeBlock { "    0"; }
add_2 = list_create_2 + code_block_2
indexOf = List.IndexOf(list=ꟿ_feet_tofraction, element=filterByBoolMask_4.in)
indexOf_2 = List.IndexOf(list=ꟿ_feet_tofraction, element=filterByBoolMask_4.out)

# group: Double
code_block_3 = CodeBlock { "0   "; }
length_2 = String.Length(string=filterByBoolMask_2.out)
number_2 = DoubleInput(2)
eq_2 = length_2 == number_2
filterByBoolMask_5 = List.FilterByBoolMask(list=filterByBoolMask_2.out, mask=eq_2)
list_create_3 = List.Create(item0=filterByBoolMask_5.in)
string_4 = StringInput("\"")
string_5 = StringInput(" ")
replace = String.Replace(string=list_create_3, searchFor=string_4, replaceWith=string_5)
add_3 = code_block_3 + replace
code_block_4 = CodeBlock { "0   "; }
length_3 = String.Length(string=filterByBoolMask_5.out)
number_3 = DoubleInput(3)
eq_3 = length_3 == number_3
filterByBoolMask_6 = List.FilterByBoolMask(list=filterByBoolMask_5.out, mask=eq_3)
list_create_4 = List.Create(item0=filterByBoolMask_6.in)
string_6 = StringInput("\"")
string_7 = StringInput(" ")
replace_2 = String.Replace(string=list_create_4, searchFor=string_6, replaceWith=string_7)
add_4 = code_block_4 + replace_2
list_create_5 = List.Create(item0=filterByBoolMask_6.out)
string_8 = StringInput("\"")
string_9 = StringInput(" ")
replace_3 = String.Replace(string=list_create_5, searchFor=string_8, replaceWith=string_9)
code_block_5 = CodeBlock { " "; }
code_block_6 = CodeBlock { "   "; }
replace_4 = String.Replace(string=replace_3, searchFor=code_block_5, replaceWith=code_block_6)
indexOf_3 = List.IndexOf(list=ꟿ_feet_tofraction, element=filterByBoolMask_5.in)
indexOf_4 = List.IndexOf(list=ꟿ_feet_tofraction, element=filterByBoolMask_6.in)
indexOf_5 = List.IndexOf(list=ꟿ_feet_tofraction, element=filterByBoolMask_6.out)

# group: Fractions
list_create_6 = List.Create(item0=filterByBoolMask_3.in)
code_block_7 = CodeBlock { " "; }
code_block_8 = CodeBlock { "  "; }
replace_5 = String.Replace(string=list_create_6, searchFor=code_block_7, replaceWith=code_block_8)
length_4 = String.Length(string=replace_5)
code_block_9 = CodeBlock { -6; 1; }
sub = length_4 - code_block_9.out1
remove = String.Remove(string=replace_5, startIndex=sub, count=code_block_9.out0)
code_block_10 = CodeBlock { "0    "; }
list_create_7 = List.Create(item0=filterByBoolMask_3.out)
length_5 = String.Length(string=list_create_7)
code_block_11 = CodeBlock { -5; 1; }
sub_2 = length_5 - code_block_11.out1
remove_2 = String.Remove(string=list_create_7, startIndex=sub_2, count=code_block_11.out0)
add_5 = code_block_10 + remove_2
indexOf_6 = List.IndexOf(list=ꟿ_feet_tofraction, element=list_create_6)
indexOf_7 = List.IndexOf(list=ꟿ_feet_tofraction, element=list_create_7)

# group: Renaming
list_create_8 = List.Create(item0=add, item1=add_2, item2=add_3, item3=add_4, item4=replace_4, item5=remove, item6=add_5)
flatten = List.Flatten(list=list_create_8)
list_create_9 = List.Create(item0=indexOf, item1=indexOf_2, item2=indexOf_3, item3=indexOf_4, item4=indexOf_5, item5=indexOf_6, item6=indexOf_7)
flatten_2 = List.Flatten(list=list_create_9)
sortByKey = List.SortByKey(list=flatten, keys=flatten_2)
length_6 = String.Length(string=sortByKey.sortedList)
number_4 = DoubleInput(3)
eq_4 = length_6 == number_4
filterByBoolMask_7 = List.FilterByBoolMask(list=sortByKey.sortedList, mask=eq_4)
list_create_10 = List.Create(item0=filterByBoolMask_7.in)
code_block_12 = CodeBlock { "0"; }
add_6 = list_create_10 + code_block_12
length_7 = String.Length(string=filterByBoolMask_7.out)
number_5 = DoubleInput(1)
eq_5 = length_7 == number_5
filterByBoolMask_8 = List.FilterByBoolMask(list=filterByBoolMask_7.out, mask=eq_5)
list_create_11 = List.Create(item0=filterByBoolMask_8.out)
list_create_12 = List.Create(item0=filterByBoolMask_8.in)
add_7 = list_create_12 + code_block_12
list_create_13 = List.Create(item0=add_6, item1=list_create_11, item2=add_7)
flatten_3 = List.Flatten(list=list_create_13)
indexOf_8 = List.IndexOf(list=sortByKey.sortedList, element=list_create_10)
indexOf_9 = List.IndexOf(list=sortByKey.sortedList, element=list_create_11)
indexOf_10 = List.IndexOf(list=sortByKey.sortedList, element=list_create_12)
list_create_14 = List.Create(item0=indexOf_8, item1=indexOf_9, item2=indexOf_10)
flatten_4 = List.Flatten(list=list_create_14)
sortByKey_2 = List.SortByKey(list=flatten_3, keys=flatten_4)
string_10 = StringInput("'")
string_11 = StringInput(" ")
replace_6 = String.Replace(string=sortByKey_2.sortedList, searchFor=string_10, replaceWith=string_11)

string_12 = Output(replace_6)  # "string"
