# Dynamo graph Auto Rename V 1.2 .dyn "Auto Rename V 1.2" (Dynamo 2.16.2.5624)
# author: Yousef Altear
# Auto Renaming of Doors & Windows
# packages: Rhythm 2023.9.1, spring nodes 210.1.1, Clockwork for Dynamo 2.x 2.6.0

# group: Auto Rename v 1.2
# note: Ⓒ Copyright of Script to Paragons Egypt Team

# group: Windows Control
categories = Categories("OST_Windows")
all_family_types_of_category = Custom[All Family Types Of Category](category=categories)  # package Clockwork for Dynamo 2.x; Gets all family types/symbols of a given category in the model.
name = Element.Name(element=all_family_types_of_category)
number_slider = DoubleSlider(0, range=0..10 step 1)
number_slider_2 = DoubleSlider(4, range=0..10 step 1)
substring = String.Substring(string=name, startIndex=number_slider, length=number_slider_2)
code_block = CodeBlock { "Main"; }
eq = substring == code_block
filterByBoolMask = List.FilterByBoolMask(list=all_family_types_of_category, mask=eq)

# group: Main Windows Data
code_block_2 = CodeBlock { "Width"; }
ʳʰʸᵗʰᵐ_elements = Rhythm.Revit.Elements.Elements.GetParameterValueByNameTypeOrInstance(element=filterByBoolMask.in, parameterName=code_block_2)
ꟿ_feet_tofraction = Custom[ꟿ Feet.ToFraction](number=ʳʰʸᵗʰᵐ_elements, lacing=Longest)  # package spring nodes; Converts a decimal foot value to a fractional foot/inch string.
string = StringInput("/256\"")
string_2 = StringInput(" ")
replace = String.Replace(string=ꟿ_feet_tofraction, searchFor=string, replaceWith=string_2)
string_3 = StringInput("'")
replace_2 = String.Replace(string=replace, searchFor=string_3, replaceWith=string_2)
number_slider_3 = DoubleSlider(0, range=0..10 step 1)
number_slider_4 = DoubleSlider(4, range=0..10 step 1)
substring_2 = String.Substring(string=replace_2, startIndex=number_slider_3, length=number_slider_4)
code_block_3 = CodeBlock { "Height"; }
ʳʰʸᵗʰᵐ_elements_2 = Rhythm.Revit.Elements.Elements.GetParameterValueByNameTypeOrInstance(element=filterByBoolMask.in, parameterName=code_block_3)
ꟿ_feet_tofraction_2 = Custom[ꟿ Feet.ToFraction](number=ʳʰʸᵗʰᵐ_elements_2, lacing=Longest)
string_4 = StringInput("/256\"")
string_5 = StringInput(" ")
replace_3 = String.Replace(string=ꟿ_feet_tofraction_2, searchFor=string_4, replaceWith=string_5)
string_6 = StringInput("'")
replace_4 = String.Replace(string=replace_3, searchFor=string_6, replaceWith=string_5)
number_slider_5 = DoubleSlider(0, range=0..10 step 1)
number_slider_6 = DoubleSlider(4, range=0..10 step 1)
substring_3 = String.Substring(string=replace_4, startIndex=number_slider_5, length=number_slider_6)
add = substring_2 + substring_3
code_block_4 = CodeBlock { " "; }
string_7 = StringInput("")
replace_5 = String.Replace(string=add, searchFor=code_block_4, replaceWith=string_7)
code_block_5 = CodeBlock { 0; }
door_window_location = CustomSelection("Main", items={Main: "Main - ", Secoundry: "Secondary - ", Interior: ""})

insert = String.Insert(string=replace_5, index=code_block_5, toInsert=door_window_location)

# group: Main Windows
name_2 = Element.Name(element=filterByBoolMask.in)
replace_6 = String.Replace(string=name_2, searchFor=name_2, replaceWith=insert)
setName = Custom[Element.SetName](element=filterByBoolMask.in, name=replace_6)  # package Clockwork for Dynamo 2.x; Gets the name of a given Revit element

# group: Secoundry Windows Data
code_block_6 = CodeBlock { "Width"; }
ʳʰʸᵗʰᵐ_elements_3 = Rhythm.Revit.Elements.Elements.GetParameterValueByNameTypeOrInstance(element=filterByBoolMask.out, parameterName=code_block_6)
ꟿ_feet_tofraction_3 = Custom[ꟿ Feet.ToFraction](number=ʳʰʸᵗʰᵐ_elements_3, lacing=Longest)
string_8 = StringInput("/256\"")
string_9 = StringInput(" ")
replace_7 = String.Replace(string=ꟿ_feet_tofraction_3, searchFor=string_8, replaceWith=string_9)
string_10 = StringInput("'")
replace_8 = String.Replace(string=replace_7, searchFor=string_10, replaceWith=string_9)
number_slider_7 = DoubleSlider(0, range=0..10 step 1)
number_slider_8 = DoubleSlider(4, range=0..10 step 1)
substring_4 = String.Substring(string=replace_8, startIndex=number_slider_7, length=number_slider_8)
code_block_7 = CodeBlock { "Height"; }
ʳʰʸᵗʰᵐ_elements_4 = Rhythm.Revit.Elements.Elements.GetParameterValueByNameTypeOrInstance(element=filterByBoolMask.out, parameterName=code_block_7)
ꟿ_feet_tofraction_4 = Custom[ꟿ Feet.ToFraction](number=ʳʰʸᵗʰᵐ_elements_4, lacing=Longest)
string_11 = StringInput("/256\"")
string_12 = StringInput(" ")
replace_9 = String.Replace(string=ꟿ_feet_tofraction_4, searchFor=string_11, replaceWith=string_12)
string_13 = StringInput("'")
replace_10 = String.Replace(string=replace_9, searchFor=string_13, replaceWith=string_12)
number_slider_9 = DoubleSlider(0, range=0..10 step 1)
number_slider_10 = DoubleSlider(4, range=0..10 step 1)
substring_5 = String.Substring(string=replace_10, startIndex=number_slider_9, length=number_slider_10)
add_2 = substring_4 + substring_5
code_block_8 = CodeBlock { " "; }
string_14 = StringInput("")
replace_11 = String.Replace(string=add_2, searchFor=code_block_8, replaceWith=string_14)
code_block_9 = CodeBlock { 0; }
door_window_location_2 = CustomSelection("Secondary", items={Main: "Main - ", Secondary: "Secondary - ", Interior: ""})

insert_2 = String.Insert(string=replace_11, index=code_block_9, toInsert=door_window_location_2)

# group: Secondary Windows
name_3 = Element.Name(element=filterByBoolMask.out)
replace_12 = String.Replace(string=name_3, searchFor=name_3, replaceWith=insert_2)
setName_2 = Custom[Element.SetName](element=filterByBoolMask.out, name=replace_12)

# group: Door Control
categories_2 = Categories("OST_Doors")
all_family_types_of_category_2 = Custom[All Family Types Of Category](category=categories_2)
name_4 = Element.Name(element=all_family_types_of_category_2)
number_slider_11 = DoubleSlider(0, range=0..10 step 1)
number_slider_12 = DoubleSlider(4, range=0..10 step 1)
substring_6 = String.Substring(string=name_4, startIndex=number_slider_11, length=number_slider_12)
code_block_10 = CodeBlock { "Main"; }
eq_2 = substring_6 == code_block_10
filterByBoolMask_2 = List.FilterByBoolMask(list=all_family_types_of_category_2, mask=eq_2)
name_5 = Element.Name(element=filterByBoolMask_2.out)
number_slider_13 = DoubleSlider(0, range=0..10 step 1)
number_slider_14 = DoubleSlider(4, range=0..10 step 1)
substring_7 = String.Substring(string=name_5, startIndex=number_slider_13, length=number_slider_14)
code_block_11 = CodeBlock { "Seco"; }
eq_3 = substring_7 == code_block_11
filterByBoolMask_3 = List.FilterByBoolMask(list=filterByBoolMask_2.out, mask=eq_3)

# group: Main Door Data
code_block_12 = CodeBlock { "Width"; }
ʳʰʸᵗʰᵐ_elements_5 = Rhythm.Revit.Elements.Elements.GetParameterValueByNameTypeOrInstance(element=filterByBoolMask_2.in, parameterName=code_block_12)
ꟿ_feet_tofraction_5 = Custom[ꟿ Feet.ToFraction](number=ʳʰʸᵗʰᵐ_elements_5, lacing=Longest)
string_15 = StringInput("/256\"")
string_16 = StringInput(" ")
replace_13 = String.Replace(string=ꟿ_feet_tofraction_5, searchFor=string_15, replaceWith=string_16)
string_17 = StringInput("'")
replace_14 = String.Replace(string=replace_13, searchFor=string_17, replaceWith=string_16)
number_slider_15 = DoubleSlider(0, range=0..10 step 1)
number_slider_16 = DoubleSlider(4, range=0..10 step 1)
substring_8 = String.Substring(string=replace_14, startIndex=number_slider_15, length=number_slider_16)
code_block_13 = CodeBlock { "Height"; }
ʳʰʸᵗʰᵐ_elements_6 = Rhythm.Revit.Elements.Elements.GetParameterValueByNameTypeOrInstance(element=filterByBoolMask_2.in, parameterName=code_block_13)
ꟿ_feet_tofraction_6 = Custom[ꟿ Feet.ToFraction](number=ʳʰʸᵗʰᵐ_elements_6, lacing=Longest)
string_18 = StringInput("/256\"")
string_19 = StringInput(" ")
replace_15 = String.Replace(string=ꟿ_feet_tofraction_6, searchFor=string_18, replaceWith=string_19)
string_20 = StringInput("'")
replace_16 = String.Replace(string=replace_15, searchFor=string_20, replaceWith=string_19)
number_slider_17 = DoubleSlider(0, range=0..10 step 1)
number_slider_18 = DoubleSlider(4, range=0..10 step 1)
substring_9 = String.Substring(string=replace_16, startIndex=number_slider_17, length=number_slider_18)
add_3 = substring_8 + substring_9
code_block_14 = CodeBlock { " "; }
string_21 = StringInput("")
replace_17 = String.Replace(string=add_3, searchFor=code_block_14, replaceWith=string_21)
code_block_15 = CodeBlock { 0; }
door_window_location_3 = CustomSelection("Main", items={Main: "Main - ", Secoundry: "Secondary - ", Interior: ""})

insert_3 = String.Insert(string=replace_17, index=code_block_15, toInsert=door_window_location_3)

# group: Main Doors
name_6 = Element.Name(element=filterByBoolMask_2.in)
replace_18 = String.Replace(string=name_6, searchFor=name_6, replaceWith=insert_3)
setName_3 = Custom[Element.SetName](element=filterByBoolMask_2.in, name=replace_18)

# group: Secoundry Door Data
code_block_16 = CodeBlock { "Width"; }
ʳʰʸᵗʰᵐ_elements_7 = Rhythm.Revit.Elements.Elements.GetParameterValueByNameTypeOrInstance(element=filterByBoolMask_3.in, parameterName=code_block_16)
watch = Watch(ʳʰʸᵗʰᵐ_elements_7)
ꟿ_feet_tofraction_7 = Custom[ꟿ Feet.ToFraction](number=watch, lacing=Longest)
string_22 = StringInput("/256\"")
string_23 = StringInput(" ")
replace_19 = String.Replace(string=ꟿ_feet_tofraction_7, searchFor=string_22, replaceWith=string_23)
string_24 = StringInput("'")
replace_20 = String.Replace(string=replace_19, searchFor=string_24, replaceWith=string_23)
number_slider_19 = DoubleSlider(0, range=0..10 step 1)
number_slider_20 = DoubleSlider(4, range=0..10 step 1)
substring_10 = String.Substring(string=replace_20, startIndex=number_slider_19, length=number_slider_20)
code_block_17 = CodeBlock { "Height"; }
ʳʰʸᵗʰᵐ_elements_8 = Rhythm.Revit.Elements.Elements.GetParameterValueByNameTypeOrInstance(element=filterByBoolMask_3.in, parameterName=code_block_17)
watch_2 = Watch(ʳʰʸᵗʰᵐ_elements_8)
ꟿ_feet_tofraction_8 = Custom[ꟿ Feet.ToFraction](number=watch_2, lacing=Longest)
string_25 = StringInput("/256\"")
string_26 = StringInput(" ")
replace_21 = String.Replace(string=ꟿ_feet_tofraction_8, searchFor=string_25, replaceWith=string_26)
string_27 = StringInput("'")
replace_22 = String.Replace(string=replace_21, searchFor=string_27, replaceWith=string_26)
number_slider_21 = DoubleSlider(0, range=0..10 step 1)
number_slider_22 = DoubleSlider(4, range=0..10 step 1)
substring_11 = String.Substring(string=replace_22, startIndex=number_slider_21, length=number_slider_22)
add_4 = substring_10 + substring_11
code_block_18 = CodeBlock { " "; }
string_28 = StringInput("")
replace_23 = String.Replace(string=add_4, searchFor=code_block_18, replaceWith=string_28)
code_block_19 = CodeBlock { 0; }
door_window_location_4 = CustomSelection("Secoudary", items={Main: "Main - ", Secoudary: "Secondary - ", Interior: ""})

insert_4 = String.Insert(string=replace_23, index=code_block_19, toInsert=door_window_location_4)

# group: Secondary Doors
name_7 = Element.Name(element=filterByBoolMask_3.in)
replace_24 = String.Replace(string=name_7, searchFor=name_7, replaceWith=insert_4)
setName_4 = Custom[Element.SetName](element=filterByBoolMask_3.in, name=replace_24)

# group: Interior Door Data
code_block_20 = CodeBlock { "Width"; }
ʳʰʸᵗʰᵐ_elements_9 = Rhythm.Revit.Elements.Elements.GetParameterValueByNameTypeOrInstance(element=filterByBoolMask_3.out, parameterName=code_block_20)
ꟿ_feet_tofraction_9 = Custom[ꟿ Feet.ToFraction](number=ʳʰʸᵗʰᵐ_elements_9, lacing=Longest)
string_29 = StringInput("/256\"")
string_30 = StringInput(" ")
replace_25 = String.Replace(string=ꟿ_feet_tofraction_9, searchFor=string_29, replaceWith=string_30)
string_31 = StringInput("'")
replace_26 = String.Replace(string=replace_25, searchFor=string_31, replaceWith=string_30)
number_slider_23 = DoubleSlider(0, range=0..10 step 1)
number_slider_24 = DoubleSlider(4, range=0..10 step 1)
substring_12 = String.Substring(string=replace_26, startIndex=number_slider_23, length=number_slider_24)
code_block_21 = CodeBlock { "Height"; }
ʳʰʸᵗʰᵐ_elements_10 = Rhythm.Revit.Elements.Elements.GetParameterValueByNameTypeOrInstance(element=filterByBoolMask_3.out, parameterName=code_block_21)
ꟿ_feet_tofraction_10 = Custom[ꟿ Feet.ToFraction](number=ʳʰʸᵗʰᵐ_elements_10, lacing=Longest)
string_32 = StringInput("/256\"")
string_33 = StringInput(" ")
replace_27 = String.Replace(string=ꟿ_feet_tofraction_10, searchFor=string_32, replaceWith=string_33)
string_34 = StringInput("'")
replace_28 = String.Replace(string=replace_27, searchFor=string_34, replaceWith=string_33)
number_slider_25 = DoubleSlider(0, range=0..10 step 1)
number_slider_26 = DoubleSlider(4, range=0..10 step 1)
substring_13 = String.Substring(string=replace_28, startIndex=number_slider_25, length=number_slider_26)
add_5 = substring_12 + substring_13
code_block_22 = CodeBlock { " "; }
string_35 = StringInput("")
replace_29 = String.Replace(string=add_5, searchFor=code_block_22, replaceWith=string_35)
code_block_23 = CodeBlock { 0; }
door_window_location_5 = CustomSelection("Interior", items={Main: "Main - ", Secoundry: "Secondary - ", Interior: ""})

insert_5 = String.Insert(string=replace_29, index=code_block_23, toInsert=door_window_location_5)

# group: Interior Doors
name_8 = Element.Name(element=filterByBoolMask_3.out)
replace_30 = String.Replace(string=name_8, searchFor=name_8, replaceWith=insert_5)
setName_5 = Custom[Element.SetName](element=filterByBoolMask_3.out, name=replace_30)

watch_3 = Watch(setName_5.element)
