# Dynamo graph Auto Rename V 1.3 .dyn "Auto Rename V 1.3" (Dynamo 2.16.2.5624)
# packages: Clockwork for Dynamo 2.x 2.6.0, spring nodes 210.1.1, Rhythm 2023.9.1

# group: Windows Control
categories = Categories("OST_Windows")
all_family_types_of_category = Custom[All Family Types Of Category](category=categories)  # package Clockwork for Dynamo 2.x; Gets all family types/symbols of a given category in the model.
name = Element.Name(element=all_family_types_of_category)
number_slider = DoubleSlider(0, range=0..10 step 1)
number_slider_2 = DoubleSlider(4, range=0..10 step 1)
substring = String.Substring(string=name, startIndex=number_slider, length=number_slider_2)
code_block = CodeBlock { "Main"; }
eq = substring == code_block
filterByBoolMask = List.FilterByBoolMask(list=all_family_types_of_category, mask=eq)

# group: Secoundry Windows Data
code_block_2 = CodeBlock { "Width"; }
ʳʰʸᵗʰᵐ_elements = Rhythm.Revit.Elements.Elements.GetParameterValueByNameTypeOrInstance(element=filterByBoolMask.out, parameterName=code_block_2)
code_block_3 = CodeBlock { 0.0334; 2; }
add = ʳʰʸᵗʰᵐ_elements + code_block_3.out0
round = Math.Round(number=add, digits=code_block_3.out1)
ꟿ_feet_tofraction = Custom[ꟿ Feet.ToFraction](number=round, lacing=Longest)  # package spring nodes; Converts a decimal foot value to a fractional foot/inch string.
string = StringInput("/256\"")
string_2 = StringInput(" ")
replace = String.Replace(string=ꟿ_feet_tofraction, searchFor=string, replaceWith=string_2)
string_3 = StringInput("'")
replace_2 = String.Replace(string=replace, searchFor=string_3, replaceWith=string_2)
number_slider_3 = DoubleSlider(0, range=0..10 step 1)
number_slider_4 = DoubleSlider(5, range=0..10 step 1)
substring_2 = String.Substring(string=replace_2, startIndex=number_slider_3, length=number_slider_4)
string_4 = StringInput("92")
string_5 = StringInput("0")
replace_3 = String.Replace(string=substring_2, searchFor=string_4, replaceWith=string_5)
code_block_4 = CodeBlock { 0; 4; }
substring_3 = String.Substring(string=replace_3, startIndex=code_block_4.out0, length=code_block_4.out1)
code_block_5 = CodeBlock { "Height"; }
ʳʰʸᵗʰᵐ_elements_2 = Rhythm.Revit.Elements.Elements.GetParameterValueByNameTypeOrInstance(element=filterByBoolMask.out, parameterName=code_block_5)
code_block_6 = CodeBlock { 0.0334; 2; }
add_2 = ʳʰʸᵗʰᵐ_elements_2 + code_block_6.out0
round_2 = Math.Round(number=add_2, digits=code_block_6.out1)
ꟿ_feet_tofraction_2 = Custom[ꟿ Feet.ToFraction](number=round_2, lacing=Longest)
string_6 = StringInput("/256\"")
string_7 = StringInput(" ")
replace_4 = String.Replace(string=ꟿ_feet_tofraction_2, searchFor=string_6, replaceWith=string_7)
string_8 = StringInput("'")
replace_5 = String.Replace(string=replace_4, searchFor=string_8, replaceWith=string_7)
number_slider_5 = DoubleSlider(0, range=0..10 step 1)
number_slider_6 = DoubleSlider(5, range=0..10 step 1)
substring_4 = String.Substring(string=replace_5, startIndex=number_slider_5, length=number_slider_6)
string_9 = StringInput("92")
string_10 = StringInput("0")
replace_6 = String.Replace(string=substring_4, searchFor=string_9, replaceWith=string_10)
code_block_7 = CodeBlock { 0; 4; }
substring_5 = String.Substring(string=replace_6, startIndex=code_block_7.out0, length=code_block_7.out1)
add_3 = substring_3 + substring_5
code_block_8 = CodeBlock { " "; }
string_11 = StringInput("")
replace_7 = String.Replace(string=add_3, searchFor=code_block_8, replaceWith=string_11)
code_block_9 = CodeBlock { 0; }
door_window_location = CustomSelection("Secondary", items={Main: "Main - ", Secondary: "Secondary - ", Interior: ""})

insert = String.Insert(string=replace_7, index=code_block_9, toInsert=door_window_location)

# group: Secondary Windows
name_2 = Element.Name(element=filterByBoolMask.out)
replace_8 = String.Replace(string=name_2, searchFor=name_2, replaceWith=insert)
setName = Custom[Element.SetName](element=filterByBoolMask.out, name=replace_8)  # package Clockwork for Dynamo 2.x; Gets the name of a given Revit element
