# Dynamo graph Auto Rename V 1.4 .dyn "Auto Rename V 1.4" (Dynamo 2.16.2.5624)
# packages: Clockwork for Dynamo 2.x 2.6.0, spring nodes 210.1.1, Rhythm 2023.9.1

# group: Windows Control
categories = Categories("OST_Windows")
all_family_types_of_category = Custom[All Family Types Of Category](category=categories)  # package Clockwork for Dynamo 2.x; Gets all family types/symbols of a given category in the model.
name = Element.Name(element=all_family_types_of_category)
number_slider = DoubleSlider(0, range=0..10 step 1)
number_slider_2 = DoubleSlider(4, range=0..10 step 1)
substring = String.Substring(string=name, startIndex=number_slider, length=number_slider_2)
code_block = CodeBlock { "Main"; }
eq = substring == code_block
filterByBoolMask = List.FilterByBoolMask(list=all_family_types_of_category, mask=eq)

# group: Secoundry Windows Data
code_block_2 = CodeBlock { "Width"; }
ʳʰʸᵗʰᵐ_elements = Rhythm.Revit.Elements.Elements.GetParameterValueByNameTypeOrInstance(element=filterByBoolMask.out, parameterName=code_block_2)
code_block_3 = CodeBlock { 0.0334; 2; }
add = ʳʰʸᵗʰᵐ_elements + code_block_3.out0
round = Math.Round(number=add, digits=code_block_3.out1)
ꟿ_feet_tofraction = Custom[ꟿ Feet.ToFraction](number=round)  # package spring nodes; Converts a decimal foot value to a fractional foot/inch string.
string = StringInput("113/256\"")
string_2 = StringInput(" ")
replace = String.Replace(string=ꟿ_feet_tofraction, searchFor=string, replaceWith=string_2)
string_3 = StringInput("102/256\"")
string_4 = StringInput(" ")
replace_2 = String.Replace(string=replace, searchFor=string_3, replaceWith=string_4, lacing=Longest)
string_5 = StringInput("92/256\"")
string_6 = StringInput(" ")
replace_3 = String.Replace(string=replace_2, searchFor=string_5, replaceWith=string_6)
string_7 = StringInput("'")
string_8 = StringInput(" ")
replace_4 = String.Replace(string=replace_3, searchFor=string_7, replaceWith=string_8)
string_9 = StringInput("  0")
add_2 = replace_4 + string_9
code_block_4 = CodeBlock { 0; 6; }
substring_2 = String.Substring(string=add_2, startIndex=code_block_4.out0, length=code_block_4.out1)
code_block_5 = CodeBlock { "Height"; }
ʳʰʸᵗʰᵐ_elements_2 = Rhythm.Revit.Elements.Elements.GetParameterValueByNameTypeOrInstance(element=filterByBoolMask.out, parameterName=code_block_5)
code_block_6 = CodeBlock { 0.0334; 2; }
add_3 = ʳʰʸᵗʰᵐ_elements_2 + code_block_6.out0
round_2 = Math.Round(number=add_3, digits=code_block_6.out1)
ꟿ_feet_tofraction_2 = Custom[ꟿ Feet.ToFraction](number=round_2, lacing=Longest)
string_10 = StringInput("113/256\"")
string_11 = StringInput(" ")
replace_5 = String.Replace(string=ꟿ_feet_tofraction_2, searchFor=string_10, replaceWith=string_11)
string_12 = StringInput("102/256\"")
string_13 = StringInput(" ")
replace_6 = String.Replace(string=replace_5, searchFor=string_12, replaceWith=string_13, lacing=Longest)
string_14 = StringInput("92/256\"")
string_15 = StringInput(" ")
replace_7 = String.Replace(string=replace_6, searchFor=string_14, replaceWith=string_15)
string_16 = StringInput("'")
string_17 = StringInput(" ")
replace_8 = String.Replace(string=replace_7, searchFor=string_16, replaceWith=string_17)
string_18 = StringInput(" 0")
add_4 = replace_8 + string_18
code_block_7 = CodeBlock { 0; 5; }
substring_3 = String.Substring(string=add_4, startIndex=code_block_7.out0, length=code_block_7.out1)
add_5 = substring_2 + substring_3
code_block_8 = CodeBlock { " "; }
string_19 = StringInput("")
replace_9 = String.Replace(string=add_5, searchFor=code_block_8, replaceWith=string_19)
code_block_9 = CodeBlock { 0; }
door_window_location = CustomSelection("Secondary", items={Main: "Main - ", Secondary: "Secondary - ", Interior: ""})
code_block_10 = CodeBlock { -1; 1; }

insert = String.Insert(string=replace_9, index=code_block_9, toInsert=door_window_location)

# group: Secondary Windows
name_2 = Element.Name(element=filterByBoolMask.out)
replace_10 = String.Replace(string=name_2, searchFor=name_2, replaceWith=insert)
setName = Custom[Element.SetName](element=filterByBoolMask.out, name=replace_10)  # package Clockwork for Dynamo 2.x; Gets the name of a given Revit element

length = String.Length(string=add_2)

# group (continued): Secoundry Windows Data
sub = length - code_block_10.out1
remove = String.Remove(string=add_2, startIndex=sub, count=code_block_10.out0)

code_block_11 = CodeBlock { "0123456789"; }
length_2 = String.Length(string=code_block_11)
code_block_12 = CodeBlock { -1; 1; }
sub_2 = length_2 - code_block_12.out1
remove_2 = String.Remove(string=code_block_11, startIndex=sub_2, count=code_block_12.out0)
watch = Watch(remove_2)
