# Dynamo graph Auto Rename V 1.5 copy .dyn "Auto Rename V 1.5 copy" (Dynamo 2.16.2.5624)
# packages: Clockwork for Dynamo 2.x 2.6.0, Rhythm 2023.9.1, spring nodes 210.1.1

# group: Windows Control
categories = Categories("OST_Windows")
all_family_types_of_category = Custom[All Family Types Of Category](category=categories)  # package Clockwork for Dynamo 2.x; Gets all family types/symbols of a given category in the model.
name = Element.Name(element=all_family_types_of_category)
length = String.Length(string=name)
code_block = CodeBlock { 4; }
eq = length == code_block
filterByBoolMask = List.FilterByBoolMask(list=all_family_types_of_category, mask=eq)
name_2 = Element.Name(element=filterByBoolMask.out)
length_2 = String.Length(string=name_2)
code_block_2 = CodeBlock { 9; }
eq_2 = length_2 == code_block_2
filterByBoolMask_2 = List.FilterByBoolMask(list=filterByBoolMask.out, mask=eq_2)
name_3 = Element.Name(element=filterByBoolMask_2.out)
number_slider = DoubleSlider(0, range=0..10 step 1)
number_slider_2 = DoubleSlider(4, range=0..10 step 1)
substring = String.Substring(string=name_3, startIndex=number_slider, length=number_slider_2)
code_block_3 = CodeBlock { "Main"; }
eq_3 = substring == code_block_3
filterByBoolMask_3 = List.FilterByBoolMask(list=filterByBoolMask_2.out, mask=eq_3)

# group: Sacondry
code_block_4 = CodeBlock { "Width"; }
ʳʰʸᵗʰᵐ_elements = Rhythm.Revit.Elements.Elements.GetParameterValueByNameTypeOrInstance(element=filterByBoolMask_3.out, parameterName=code_block_4)
ꟿ_feet_tofraction = Custom[ꟿ Feet.ToFraction](number=ʳʰʸᵗʰᵐ_elements)  # package spring nodes; Converts a decimal foot value to a fractional foot/inch string.
string = StringInput("/")
contains = String.Contains(string=ꟿ_feet_tofraction, searchFor=string)
filterByBoolMask_4 = List.FilterByBoolMask(list=filterByBoolMask_3.out, mask=contains)
code_block_5 = CodeBlock { "Width"; }
ʳʰʸᵗʰᵐ_elements_2 = Rhythm.Revit.Elements.Elements.GetParameterValueByNameTypeOrInstance(element=filterByBoolMask_4.out, parameterName=code_block_5)
number_slider_3 = DoubleSlider(2, range=0..100 step 1)
round = Math.Round(number=ʳʰʸᵗʰᵐ_elements_2, digits=number_slider_3)
ꟿ_feet_tofraction_2 = Custom[ꟿ Feet.ToFraction](number=round)
code_block_6 = CodeBlock { "Width"; }
ʳʰʸᵗʰᵐ_elements_3 = Rhythm.Revit.Elements.Elements.GetParameterValueByNameTypeOrInstance(element=filterByBoolMask_4.out, parameterName=code_block_6)
ꟿ_feet_tofraction_3 = Custom[ꟿ Feet.ToFraction](number=ʳʰʸᵗʰᵐ_elements_3)
ꟿ_feet_tofraction_4 = Custom[ꟿ Feet.ToFraction](number=ʳʰʸᵗʰᵐ_elements_2)
name_4 = Element.Name(element=filterByBoolMask_4.in)

# group: Filtration Area
string_2 = StringInput("\"")
boolean = BoolSelector(true)
contains_2 = String.Contains(string=ꟿ_feet_tofraction, searchFor=string_2, ignoreCase=boolean)
filterByBoolMask_5 = List.FilterByBoolMask(list=ꟿ_feet_tofraction, mask=contains_2)
string_3 = StringInput("/")
contains_3 = String.Contains(string=filterByBoolMask_5.in, searchFor=string_3)
filterByBoolMask_6 = List.FilterByBoolMask(list=filterByBoolMask_5.in, mask=contains_3)
string_4 = StringInput("'")
boolean_2 = BoolSelector(true)
contains_4 = String.Contains(string=filterByBoolMask_6.in, searchFor=string_4, ignoreCase=boolean_2)
filterByBoolMask_7 = List.FilterByBoolMask(list=filterByBoolMask_6.in, mask=contains_4)

# group: ' Single
length_3 = String.Length(string=filterByBoolMask_5.out)
number = DoubleInput(2)
eq_4 = length_3 == number
filterByBoolMask_8 = List.FilterByBoolMask(list=filterByBoolMask_5.out, mask=eq_4)
list_create = List.Create(item0=filterByBoolMask_8.in)
code_block_7 = CodeBlock { "    0"; }
add = list_create + code_block_7
list_create_2 = List.Create(item0=filterByBoolMask_8.out)
code_block_8 = CodeBlock { "    0"; }
add_2 = list_create_2 + code_block_8
indexOf = List.IndexOf(list=ꟿ_feet_tofraction, element=filterByBoolMask_8.in)
indexOf_2 = List.IndexOf(list=ꟿ_feet_tofraction, element=filterByBoolMask_8.out)

# group: " Double
code_block_9 = CodeBlock { "0   "; }
length_4 = String.Length(string=filterByBoolMask_6.out)
number_2 = DoubleInput(2)
eq_5 = length_4 == number_2
filterByBoolMask_9 = List.FilterByBoolMask(list=filterByBoolMask_6.out, mask=eq_5)
list_create_3 = List.Create(item0=filterByBoolMask_9.in)
string_5 = StringInput("\"")
string_6 = StringInput(" ")
replace = String.Replace(string=list_create_3, searchFor=string_5, replaceWith=string_6)
add_3 = code_block_9 + replace
code_block_10 = CodeBlock { "0   "; }
length_5 = String.Length(string=filterByBoolMask_9.out)
number_3 = DoubleInput(3)
eq_6 = length_5 == number_3
filterByBoolMask_10 = List.FilterByBoolMask(list=filterByBoolMask_9.out, mask=eq_6)
list_create_4 = List.Create(item0=filterByBoolMask_10.in)
string_7 = StringInput("\"")
string_8 = StringInput(" ")
replace_2 = String.Replace(string=list_create_4, searchFor=string_7, replaceWith=string_8)
add_4 = code_block_10 + replace_2
list_create_5 = List.Create(item0=filterByBoolMask_10.out)
string_9 = StringInput("\"")
string_10 = StringInput(" ")
replace_3 = String.Replace(string=list_create_5, searchFor=string_9, replaceWith=string_10)
code_block_11 = CodeBlock { " "; }
code_block_12 = CodeBlock { "   "; }
replace_4 = String.Replace(string=replace_3, searchFor=code_block_11, replaceWith=code_block_12)
indexOf_3 = List.IndexOf(list=ꟿ_feet_tofraction, element=filterByBoolMask_9.in)
indexOf_4 = List.IndexOf(list=ꟿ_feet_tofraction, element=filterByBoolMask_10.in)
indexOf_5 = List.IndexOf(list=ꟿ_feet_tofraction, element=filterByBoolMask_10.out)

# group: Fraction
list_create_6 = List.Create(item0=filterByBoolMask_7.in)
code_block_13 = CodeBlock { " "; }
code_block_14 = CodeBlock { "  "; }
replace_5 = String.Replace(string=list_create_6, searchFor=code_block_13, replaceWith=code_block_14)
length_6 = String.Length(string=replace_5)
code_block_15 = CodeBlock { -6; 1; }
sub = length_6 - code_block_15.out1
remove = String.Remove(string=replace_5, startIndex=sub, count=code_block_15.out0)
code_block_16 = CodeBlock { "0    "; }
list_create_7 = List.Create(item0=filterByBoolMask_7.out)
length_7 = String.Length(string=list_create_7)
code_block_17 = CodeBlock { -5; 1; }
sub_2 = length_7 - code_block_17.out1
remove_2 = String.Remove(string=list_create_7, startIndex=sub_2, count=code_block_17.out0)
add_5 = code_block_16 + remove_2
indexOf_6 = List.IndexOf(list=ꟿ_feet_tofraction, element=list_create_6)
indexOf_7 = List.IndexOf(list=ꟿ_feet_tofraction, element=list_create_7)

# group: After Rename
list_create_8 = List.Create(item0=add, item1=add_2, item2=add_3, item3=add_4, item4=replace_4, item5=remove, item6=add_5)
flatten = List.Flatten(list=list_create_8)
list_create_9 = List.Create(item0=indexOf, item1=indexOf_2, item2=indexOf_3, item3=indexOf_4, item4=indexOf_5, item5=indexOf_6, item6=indexOf_7)
flatten_2 = List.Flatten(list=list_create_9)
sortByKey = List.SortByKey(list=flatten, keys=flatten_2)
length_8 = String.Length(string=sortByKey.sortedList)
number_4 = DoubleInput(3)
eq_7 = length_8 == number_4
filterByBoolMask_11 = List.FilterByBoolMask(list=sortByKey.sortedList, mask=eq_7)
list_create_10 = List.Create(item0=filterByBoolMask_11.in)
code_block_18 = CodeBlock { "0"; }
add_6 = list_create_10 + code_block_18
length_9 = String.Length(string=filterByBoolMask_11.out)
number_5 = DoubleInput(1)
eq_8 = length_9 == number_5
filterByBoolMask_12 = List.FilterByBoolMask(list=filterByBoolMask_11.out, mask=eq_8)
list_create_11 = List.Create(item0=filterByBoolMask_12.out)
list_create_12 = List.Create(item0=filterByBoolMask_12.in)
add_7 = list_create_12 + code_block_18
list_create_13 = List.Create(item0=add_6, item1=list_create_11, item2=add_7)
flatten_3 = List.Flatten(list=list_create_13)
indexOf_8 = List.IndexOf(list=sortByKey.sortedList, element=list_create_10)
indexOf_9 = List.IndexOf(list=sortByKey.sortedList, element=list_create_11)
indexOf_10 = List.IndexOf(list=sortByKey.sortedList, element=list_create_12)
list_create_14 = List.Create(item0=indexOf_8, item1=indexOf_9, item2=indexOf_10)
flatten_4 = List.Flatten(list=list_create_14)
sortByKey_2 = List.SortByKey(list=flatten_3, keys=flatten_4)
string_11 = StringInput("'")
string_12 = StringInput(" ")
replace_6 = String.Replace(string=sortByKey_2.sortedList, searchFor=string_11, replaceWith=string_12)

# group: Add Type
add_8 = replace_6 + _  # unwired: y
code_block_19 = CodeBlock { " "; }
string_13 = StringInput("")
replace_7 = String.Replace(string=add_8, searchFor=code_block_19, replaceWith=string_13)
code_block_20 = CodeBlock { 0; }
door_window_location = CustomSelection("Secondary", items={Main: "Main - ", Secondary: "Secondary - ", Interior: ""})
insert = String.Insert(string=replace_7, index=code_block_20, toInsert=door_window_location)

# group: Secondary Windows
name_5 = Element.Name(element=filterByBoolMask_3.out)
replace_8 = String.Replace(string=name_5, searchFor=name_5, replaceWith=insert)
setName = Custom[Element.SetName](element=filterByBoolMask_3.out, name=replace_8)  # frozen; package Clockwork for Dynamo 2.x; Gets the name of a given Revit element

# group: Main
code_block_21 = CodeBlock { "Width"; }
ʳʰʸᵗʰᵐ_elements_4 = Rhythm.Revit.Elements.Elements.GetParameterValueByNameTypeOrInstance(element=filterByBoolMask_3.in, parameterName=code_block_21)
ꟿ_feet_tofraction_5 = Custom[ꟿ Feet.ToFraction](number=ʳʰʸᵗʰᵐ_elements_4)
string_14 = StringInput("/")
contains_5 = String.Contains(string=ꟿ_feet_tofraction_5, searchFor=string_14)
filterByBoolMask_13 = List.FilterByBoolMask(list=filterByBoolMask_3.in, mask=contains_5)
