# Dynamo graph Auto Rename V 1.7 .dyn "Auto Rename V 1.7" (Dynamo 2.16.2.5624)
# packages: Clockwork for Dynamo 2.x 2.6.0, spring nodes 210.1.1, Rhythm 2023.9.1, ParadigmPackage 0.0.1

# group: Windows Control
categories = Categories("OST_Windows")
all_family_types_of_category = Custom[All Family Types Of Category](category=categories)  # package Clockwork for Dynamo 2.x; Gets all family types/symbols of a given category in the model.
name = Element.Name(element=all_family_types_of_category)
length = String.Length(string=name)
code_block = CodeBlock { 4; }
eq = length == code_block
filterByBoolMask = List.FilterByBoolMask(list=all_family_types_of_category, mask=eq)
name_2 = Element.Name(element=filterByBoolMask.out)
length_2 = String.Length(string=name_2)
code_block_2 = CodeBlock { 9; }
eq_2 = length_2 == code_block_2
filterByBoolMask_2 = List.FilterByBoolMask(list=filterByBoolMask.out, mask=eq_2)
name_3 = Element.Name(element=filterByBoolMask_2.out)
number_slider = DoubleSlider(0, range=0..10 step 1)
number_slider_2 = DoubleSlider(4, range=0..10 step 1)
substring = String.Substring(string=name_3, startIndex=number_slider, length=number_slider_2)
code_block_3 = CodeBlock { "Main"; }
eq_3 = substring == code_block_3
filterByBoolMask_3 = List.FilterByBoolMask(list=filterByBoolMask_2.out, mask=eq_3)

# group: Width
code_block_4 = CodeBlock { "Width"; }
ʳʰʸᵗʰᵐ_elements = Rhythm.Revit.Elements.Elements.GetParameterValueByNameTypeOrInstance(element=filterByBoolMask_3.out, parameterName=code_block_4)
ꟿ_feet_tofraction = Custom[ꟿ Feet.ToFraction](number=ʳʰʸᵗʰᵐ_elements)  # package spring nodes; Converts a decimal foot value to a fractional foot/inch string.
autoRename = Custom[AutoRename](list=ꟿ_feet_tofraction)  # package ParadigmPackage; Renaming of openings in Projects

# group: Height
code_block_5 = CodeBlock { "Height"; }
ʳʰʸᵗʰᵐ_elements_2 = Rhythm.Revit.Elements.Elements.GetParameterValueByNameTypeOrInstance(element=filterByBoolMask_3.out, parameterName=code_block_5)
ꟿ_feet_tofraction_2 = Custom[ꟿ Feet.ToFraction](number=ʳʰʸᵗʰᵐ_elements_2)
autoRename_2 = Custom[AutoRename](list=ꟿ_feet_tofraction_2)

# group: Secondry Windows
add = autoRename + autoRename_2
code_block_6 = CodeBlock { " "; }
string = StringInput("")
replace = String.Replace(string=add, searchFor=code_block_6, replaceWith=string)
code_block_7 = CodeBlock { 0; }
door_window_location = CustomSelection("Secondary", items={Main: "Main - ", Secondary: "Secondary - ", Interior: ""})
insert = String.Insert(string=replace, index=code_block_7, toInsert=door_window_location)

# group: Secondary Windows Rename
name_4 = Element.Name(element=filterByBoolMask_3.out)
replace_2 = String.Replace(string=name_4, searchFor=name_4, replaceWith=insert)
flatten = List.Flatten(list=replace_2)
setName = Custom[Element.SetName](element=filterByBoolMask_3.out, name=flatten)  # package Clockwork for Dynamo 2.x; Gets the name of a given Revit element

# group: Width
code_block_8 = CodeBlock { "Width"; }
ʳʰʸᵗʰᵐ_elements_3 = Rhythm.Revit.Elements.Elements.GetParameterValueByNameTypeOrInstance(element=filterByBoolMask_3.in, parameterName=code_block_8)
ꟿ_feet_tofraction_3 = Custom[ꟿ Feet.ToFraction](number=ʳʰʸᵗʰᵐ_elements_3)
autoRename_3 = Custom[AutoRename](list=ꟿ_feet_tofraction_3)

# group: Height
code_block_9 = CodeBlock { "Height"; }
ʳʰʸᵗʰᵐ_elements_4 = Rhythm.Revit.Elements.Elements.GetParameterValueByNameTypeOrInstance(element=filterByBoolMask_3.in, parameterName=code_block_9)
ꟿ_feet_tofraction_4 = Custom[ꟿ Feet.ToFraction](number=ʳʰʸᵗʰᵐ_elements_4)
autoRename_4 = Custom[AutoRename](list=ꟿ_feet_tofraction_4)

# group: Main Windows
add_2 = autoRename_3 + autoRename_4
code_block_10 = CodeBlock { " "; }
string_2 = StringInput("")
replace_3 = String.Replace(string=add_2, searchFor=code_block_10, replaceWith=string_2)
code_block_11 = CodeBlock { 0; }
door_window_location_2 = CustomSelection("Main", items={Main: "Main - ", Secondary: "Secondary - ", Interior: ""})
insert_2 = String.Insert(string=replace_3, index=code_block_11, toInsert=door_window_location_2)

# group: Secondary Windows Rename
name_5 = Element.Name(element=filterByBoolMask_3.in)
replace_4 = String.Replace(string=name_5, searchFor=name_5, replaceWith=insert_2)
flatten_2 = List.Flatten(list=replace_4)
setName_2 = Custom[Element.SetName](element=filterByBoolMask_3.in, name=flatten_2)

# group: Door Control
categories_2 = Categories("OST_Doors")
all_family_types_of_category_2 = Custom[All Family Types Of Category](category=categories_2)
name_6 = Element.Name(element=all_family_types_of_category_2)
number_slider_3 = DoubleSlider(0, range=0..10 step 1)
number_slider_4 = DoubleSlider(4, range=0..10 step 1)
substring_2 = String.Substring(string=name_6, startIndex=number_slider_3, length=number_slider_4)
code_block_12 = CodeBlock { "Main"; }
eq_4 = substring_2 == code_block_12
filterByBoolMask_4 = List.FilterByBoolMask(list=all_family_types_of_category_2, mask=eq_4)
name_7 = Element.Name(element=filterByBoolMask_4.out)
number_slider_5 = DoubleSlider(0, range=0..10 step 1)
number_slider_6 = DoubleSlider(4, range=0..10 step 1)
substring_3 = String.Substring(string=name_7, startIndex=number_slider_5, length=number_slider_6)
code_block_13 = CodeBlock { "Seco"; }
eq_5 = substring_3 == code_block_13
filterByBoolMask_5 = List.FilterByBoolMask(list=filterByBoolMask_4.out, mask=eq_5)

# group: Width
code_block_14 = CodeBlock { "Width"; }
ʳʰʸᵗʰᵐ_elements_5 = Rhythm.Revit.Elements.Elements.GetParameterValueByNameTypeOrInstance(element=filterByBoolMask_5.in, parameterName=code_block_14)
ꟿ_feet_tofraction_5 = Custom[ꟿ Feet.ToFraction](number=ʳʰʸᵗʰᵐ_elements_5)
autoRename_5 = Custom[AutoRename](list=ꟿ_feet_tofraction_5)

# group: Height
code_block_15 = CodeBlock { "Height"; }
ʳʰʸᵗʰᵐ_elements_6 = Rhythm.Revit.Elements.Elements.GetParameterValueByNameTypeOrInstance(element=filterByBoolMask_5.in, parameterName=code_block_15)
ꟿ_feet_tofraction_6 = Custom[ꟿ Feet.ToFraction](number=ʳʰʸᵗʰᵐ_elements_6)
autoRename_6 = Custom[AutoRename](list=ꟿ_feet_tofraction_6)

# group: Secondry Doors
add_3 = autoRename_5 + autoRename_6
code_block_16 = CodeBlock { " "; }
string_3 = StringInput("")
replace_5 = String.Replace(string=add_3, searchFor=code_block_16, replaceWith=string_3)
code_block_17 = CodeBlock { 0; }
door_window_location_3 = CustomSelection("Secondary", items={Main: "Main - ", Secondary: "Secondary - ", Interior: ""})
insert_3 = String.Insert(string=replace_5, index=code_block_17, toInsert=door_window_location_3)

# group: Secondary Doors Rename
name_8 = Element.Name(element=filterByBoolMask_5.in)
replace_6 = String.Replace(string=name_8, searchFor=name_8, replaceWith=insert_3)
flatten_3 = List.Flatten(list=replace_6)
setName_3 = Custom[Element.SetName](element=filterByBoolMask_5.in, name=flatten_3)

# group: Width
code_block_18 = CodeBlock { "Width"; }
ʳʰʸᵗʰᵐ_elements_7 = Rhythm.Revit.Elements.Elements.GetParameterValueByNameTypeOrInstance(element=filterByBoolMask_4.in, parameterName=code_block_18)
ꟿ_feet_tofraction_7 = Custom[ꟿ Feet.ToFraction](number=ʳʰʸᵗʰᵐ_elements_7)
autoRename_7 = Custom[AutoRename](list=ꟿ_feet_tofraction_7)

# group: Height
code_block_19 = CodeBlock { "Height"; }
ʳʰʸᵗʰᵐ_elements_8 = Rhythm.Revit.Elements.Elements.GetParameterValueByNameTypeOrInstance(element=filterByBoolMask_4.in, parameterName=code_block_19)
ꟿ_feet_tofraction_8 = Custom[ꟿ Feet.ToFraction](number=ʳʰʸᵗʰᵐ_elements_8)
autoRename_8 = Custom[AutoRename](list=ꟿ_feet_tofraction_8)

# group: Main Doors
add_4 = autoRename_7 + autoRename_8
code_block_20 = CodeBlock { " "; }
string_4 = StringInput("")
replace_7 = String.Replace(string=add_4, searchFor=code_block_20, replaceWith=string_4)
code_block_21 = CodeBlock { 0; }
door_window_location_4 = CustomSelection("Secondary", items={Main: "Main - ", Secondary: "Secondary - ", Interior: ""})
insert_4 = String.Insert(string=replace_7, index=code_block_21, toInsert=door_window_location_4)

# group: Secondary Doors Rename
name_9 = Element.Name(element=filterByBoolMask_4.in)
replace_8 = String.Replace(string=name_9, searchFor=name_9, replaceWith=insert_4)
flatten_4 = List.Flatten(list=replace_8)
setName_4 = Custom[Element.SetName](element=filterByBoolMask_4.in, name=flatten_4)

# group: Width
code_block_22 = CodeBlock { "Width"; }
ʳʰʸᵗʰᵐ_elements_9 = Rhythm.Revit.Elements.Elements.GetParameterValueByNameTypeOrInstance(element=filterByBoolMask_5.out, parameterName=code_block_22)
ꟿ_feet_tofraction_9 = Custom[ꟿ Feet.ToFraction](number=ʳʰʸᵗʰᵐ_elements_9)
autoRename_9 = Custom[AutoRename](list=ꟿ_feet_tofraction_9)

# group: Height
code_block_23 = CodeBlock { "Height"; }
ʳʰʸᵗʰᵐ_elements_10 = Rhythm.Revit.Elements.Elements.GetParameterValueByNameTypeOrInstance(element=filterByBoolMask_5.out, parameterName=code_block_23)
ꟿ_feet_tofraction_10 = Custom[ꟿ Feet.ToFraction](number=ʳʰʸᵗʰᵐ_elements_10)
autoRename_10 = Custom[AutoRename](list=ꟿ_feet_tofraction_10)

# group: Interior Door
add_5 = autoRename_9 + autoRename_10
code_block_24 = CodeBlock { " "; }
string_5 = StringInput("")
replace_9 = String.Replace(string=add_5, searchFor=code_block_24, replaceWith=string_5)
code_block_25 = CodeBlock { 0; }
door_window_location_5 = CustomSelection("Interior", items={Main: "Main - ", Secondary: "Secondary - ", Interior: ""})
insert_5 = String.Insert(string=replace_9, index=code_block_25, toInsert=door_window_location_5)

# group: Interior Doors Rename
name_10 = Element.Name(element=filterByBoolMask_5.out)
replace_10 = String.Replace(string=name_10, searchFor=name_10, replaceWith=insert_5)
flatten_5 = List.Flatten(list=replace_10)
setName_5 = Custom[Element.SetName](element=filterByBoolMask_5.out, name=flatten_5)

# group: Type Rename
categories_3 = Categories("OST_Ceilings")
all_family_types_of_category_3 = Custom[All Family Types Of Category](category=categories_3)
name_11 = Custom[Element.Name+](element=all_family_types_of_category_3)  # package Clockwork for Dynamo 2.x; Gets an element's name. Unlike the OOTB node, this node should work for *all* Revit elements that have names and will also return the localized names of system parameters, parameter groups, display unit types, parameter types, unit symbol types, unit types and ForgeTypeIds.
string_6 = StringInput("Ceilings")
contains = String.Contains(string=name_11, searchFor=string_6)
eq_6 = name_11 == contains
filterByBoolMask_6 = List.FilterByBoolMask(list=all_family_types_of_category_3, mask=eq_6)
name_12 = Element.Name(element=filterByBoolMask_6.in)
string_7 = StringInput("WTS_Interior_Ceiling ")
replace_11 = String.Replace(string=name_12, searchFor=name_12, replaceWith=string_7)
setName_6 = Custom[Element.SetName](element=filterByBoolMask_6.in, name=replace_11)

# group: Category Rename
categories_4 = Categories("OST_Ceilings")
all_families_of_category = Custom[All Families Of Category](category=categories_4)  # package Clockwork for Dynamo 2.x; Gets all famiies of a given category in the model (does *not *work for system families)
name_13 = Custom[Element.Name+](element=all_families_of_category)
string_8 = StringInput("Ceilings")
contains_2 = String.Contains(string=name_13, searchFor=string_8)
eq_7 = name_13 == contains_2
filterByBoolMask_7 = List.FilterByBoolMask(list=all_families_of_category, mask=eq_7)
name_14 = Element.Name(element=filterByBoolMask_7.in)
string_9 = StringInput("Compound Ceiling Cut")
replace_12 = String.Replace(string=name_14, searchFor=name_14, replaceWith=string_9)
code_block_26 = CodeBlock { " "; }
indexOf = List.IndexOf(list=filterByBoolMask_7.in, element=filterByBoolMask_7.in)
string_from_object = FromObject(object=indexOf)
string_10 = StringInput("0")
string_11 = StringInput("")
replace_13 = String.Replace(string=string_from_object, searchFor=string_10, replaceWith=string_11)
add_6 = code_block_26 + replace_13
add_7 = replace_12 + add_6
replace_14 = String.Replace(string=name_14, searchFor=name_14, replaceWith=add_7)
trimTrailingWhitespace = String.TrimTrailingWhitespace(string=replace_14)
setName_7 = Custom[Element.SetName](element=filterByBoolMask_7.in, name=trimTrailingWhitespace)

# group: Type Rename
categories_5 = Categories("OST_Roofs")
all_family_types_of_category_4 = Custom[All Family Types Of Category](category=categories_5)
name_15 = Custom[Element.Name+](element=all_family_types_of_category_4)
string_12 = StringInput("Roofs ")
contains_3 = String.Contains(string=name_15, searchFor=string_12)
eq_8 = name_15 == contains_3
filterByBoolMask_8 = List.FilterByBoolMask(list=all_family_types_of_category_4, mask=eq_8)
name_16 = Element.Name(element=filterByBoolMask_8.in)
string_13 = StringInput("WTS_Roof_Covering")
replace_15 = String.Replace(string=name_16, searchFor=name_16, replaceWith=string_13)
setName_8 = Custom[Element.SetName](element=filterByBoolMask_8.in, name=replace_15)

# group: Category Rename
categories_6 = Categories("OST_Roofs")
all_families_of_category_2 = Custom[All Families Of Category](category=categories_6)
name_17 = Custom[Element.Name+](element=all_families_of_category_2)
string_14 = StringInput("Roofs ")
contains_4 = String.Contains(string=name_17, searchFor=string_14)
eq_9 = name_17 == contains_4
filterByBoolMask_9 = List.FilterByBoolMask(list=all_families_of_category_2, mask=eq_9)
name_18 = Element.Name(element=filterByBoolMask_9.in)
string_15 = StringInput("Basic Roof ")
replace_16 = String.Replace(string=name_18, searchFor=name_18, replaceWith=string_15)
indexOf_2 = List.IndexOf(list=filterByBoolMask_9.in, element=filterByBoolMask_9.in)
code_block_27 = CodeBlock { 1; }
add_8 = indexOf_2 + code_block_27
string_from_object_2 = FromObject(object=add_8)
add_9 = replace_16 + string_from_object_2
replace_17 = String.Replace(string=name_18, searchFor=name_18, replaceWith=add_9)
setName_9 = Custom[Element.SetName](element=filterByBoolMask_9.in, name=replace_17)

# group: Walls
categories_7 = Categories("OST_Walls")
all_family_types_of_category_5 = Custom[All Family Types Of Category](category=categories_7)
name_19 = Custom[Element.Name+](element=all_family_types_of_category_5)
string_16 = StringInput("Stone")
contains_5 = String.Contains(string=name_19, searchFor=string_16)
eq_10 = name_19 == contains_5
filterByBoolMask_10 = List.FilterByBoolMask(list=all_family_types_of_category_5, mask=eq_10)
name_20 = Element.Name(element=filterByBoolMask_10.in)
string_17 = StringInput(" - ")
code_block_28 = CodeBlock { "Width"; }
ʳʰʸᵗʰᵐ_elements_11 = Rhythm.Revit.Elements.Elements.GetParameterValueByNameTypeOrInstance(element=filterByBoolMask_10.in, parameterName=code_block_28)
ꟿ_feet_tofraction_11 = Custom[ꟿ Feet.ToFraction](number=ʳʰʸᵗʰᵐ_elements_11)
add_10 = string_17 + ꟿ_feet_tofraction_11

add_11 = name_20 + add_10

# group (continued): Walls
replace_18 = String.Replace(string=name_20, searchFor=name_20, replaceWith=add_11)
setName_10 = Custom[Element.SetName](element=filterByBoolMask_10.in, name=replace_18)
