# Dynamo graph Auto Rename V 1.8 .dyn "Auto Rename V 1.8" (Dynamo 2.16.2.5624)
# author: Yousef Altear
# Auto Renaming of Doors , Windows ,Roof Cuts ,Ceiling Cuts and Stone Wall
# packages: Clockwork for Dynamo 2.x 2.6.0, ParadigmPackage 0.0.1, spring nodes 210.1.1, Rhythm 2023.9.1

# group: Auto Rename v 1.9
# note: Ⓒ Copyright of Script to Paragons Egypt Team

# group: Door Control
categories = Categories("OST_Doors")
all_family_types_of_category = Custom[All Family Types Of Category](category=categories)  # package Clockwork for Dynamo 2.x; Gets all family types/symbols of a given category in the model.
name = Element.Name(element=all_family_types_of_category)
number_slider = DoubleSlider(0, range=0..10 step 1)
number_slider_2 = DoubleSlider(4, range=0..10 step 1)
substring = String.Substring(string=name, startIndex=number_slider, length=number_slider_2)
code_block = CodeBlock { "Main"; }
eq = substring == code_block
filterByBoolMask = List.FilterByBoolMask(list=all_family_types_of_category, mask=eq)
name_2 = Element.Name(element=filterByBoolMask.out)
number_slider_3 = DoubleSlider(0, range=0..10 step 1)
number_slider_4 = DoubleSlider(4, range=0..10 step 1)
substring_2 = String.Substring(string=name_2, startIndex=number_slider_3, length=number_slider_4)
code_block_2 = CodeBlock { "Seco"; }
eq_2 = substring_2 == code_block_2
filterByBoolMask_2 = List.FilterByBoolMask(list=filterByBoolMask.out, mask=eq_2)

# group: Width
code_block_3 = CodeBlock { "Width"; }
ʳʰʸᵗʰᵐ_elements = Rhythm.Revit.Elements.Elements.GetParameterValueByNameTypeOrInstance(element=filterByBoolMask_2.out, parameterName=code_block_3)
number_slider_5 = DoubleSlider(2, range=0..100 step 1)
round = Math.Round(number=ʳʰʸᵗʰᵐ_elements, digits=number_slider_5)
ꟿ_feet_tofraction = Custom[ꟿ Feet.ToFraction](number=round)  # package spring nodes; Converts a decimal foot value to a fractional foot/inch string.
autoRename = Custom[AutoRename](list=ꟿ_feet_tofraction)  # package ParadigmPackage; Renaming of openings in Projects

# group: Height
code_block_4 = CodeBlock { "Height"; }
ʳʰʸᵗʰᵐ_elements_2 = Rhythm.Revit.Elements.Elements.GetParameterValueByNameTypeOrInstance(element=filterByBoolMask_2.out, parameterName=code_block_4)
number_slider_6 = DoubleSlider(2, range=0..100 step 1)
round_2 = Math.Round(number=ʳʰʸᵗʰᵐ_elements_2, digits=number_slider_6)
ꟿ_feet_tofraction_2 = Custom[ꟿ Feet.ToFraction](number=round_2)
autoRename_2 = Custom[AutoRename](list=ꟿ_feet_tofraction_2)

# group: Interior Door
add = autoRename + autoRename_2
code_block_5 = CodeBlock { " "; }
string = StringInput("")
replace = String.Replace(string=add, searchFor=code_block_5, replaceWith=string)
code_block_6 = CodeBlock { 0; }
door_window_location = CustomSelection("Interior", items={Main: "Main - ", Secondary: "Secondary - ", Interior: ""})
insert = String.Insert(string=replace, index=code_block_6, toInsert=door_window_location)

# group: Interior Doors Rename
name_3 = Element.Name(element=filterByBoolMask_2.out)
replace_2 = String.Replace(string=name_3, searchFor=name_3, replaceWith=insert)
flatten = List.Flatten(list=replace_2)
setName = Custom[Element.SetName](element=filterByBoolMask_2.out, name=flatten)  # package Clockwork for Dynamo 2.x; Gets the name of a given Revit element

# group: Width
code_block_7 = CodeBlock { "Width"; }
ʳʰʸᵗʰᵐ_elements_3 = Rhythm.Revit.Elements.Elements.GetParameterValueByNameTypeOrInstance(element=filterByBoolMask_2.in, parameterName=code_block_7)
number_slider_7 = DoubleSlider(2, range=0..100 step 1)
round_3 = Math.Round(number=ʳʰʸᵗʰᵐ_elements_3, digits=number_slider_7)
ꟿ_feet_tofraction_3 = Custom[ꟿ Feet.ToFraction](number=round_3)
autoRename_3 = Custom[AutoRename](list=ꟿ_feet_tofraction_3)

# group: Height
code_block_8 = CodeBlock { "Height"; }
ʳʰʸᵗʰᵐ_elements_4 = Rhythm.Revit.Elements.Elements.GetParameterValueByNameTypeOrInstance(element=filterByBoolMask_2.in, parameterName=code_block_8)
number_slider_8 = DoubleSlider(2, range=0..100 step 1)
round_4 = Math.Round(number=ʳʰʸᵗʰᵐ_elements_4, digits=number_slider_8)
ꟿ_feet_tofraction_4 = Custom[ꟿ Feet.ToFraction](number=round_4)
autoRename_4 = Custom[AutoRename](list=ꟿ_feet_tofraction_4)

# group: Secondry Doors
add_2 = autoRename_3 + autoRename_4
code_block_9 = CodeBlock { " "; }
string_2 = StringInput("")
replace_3 = String.Replace(string=add_2, searchFor=code_block_9, replaceWith=string_2)
code_block_10 = CodeBlock { 0; }
door_window_location_2 = CustomSelection("Secondary", items={Main: "Main - ", Secondary: "Secondary - ", Interior: ""})
insert_2 = String.Insert(string=replace_3, index=code_block_10, toInsert=door_window_location_2)

# group: Secondary Doors Rename
name_4 = Element.Name(element=filterByBoolMask_2.in)
replace_4 = String.Replace(string=name_4, searchFor=name_4, replaceWith=insert_2)
flatten_2 = List.Flatten(list=replace_4)
setName_2 = Custom[Element.SetName](element=filterByBoolMask_2.in, name=flatten_2)

# group: Width
code_block_11 = CodeBlock { "Width"; }
ʳʰʸᵗʰᵐ_elements_5 = Rhythm.Revit.Elements.Elements.GetParameterValueByNameTypeOrInstance(element=filterByBoolMask.in, parameterName=code_block_11)
number_slider_9 = DoubleSlider(2, range=0..100 step 1)
round_5 = Math.Round(number=ʳʰʸᵗʰᵐ_elements_5, digits=number_slider_9)
ꟿ_feet_tofraction_5 = Custom[ꟿ Feet.ToFraction](number=round_5)
autoRename_5 = Custom[AutoRename](list=ꟿ_feet_tofraction_5)

# group: Height
code_block_12 = CodeBlock { "Height"; }
ʳʰʸᵗʰᵐ_elements_6 = Rhythm.Revit.Elements.Elements.GetParameterValueByNameTypeOrInstance(element=filterByBoolMask.in, parameterName=code_block_12)
number_slider_10 = DoubleSlider(2, range=0..100 step 1)

round_6 = Math.Round(number=ʳʰʸᵗʰᵐ_elements_6, digits=number_slider_10)

# group (continued): Height
ꟿ_feet_tofraction_6 = Custom[ꟿ Feet.ToFraction](number=round_6)
autoRename_6 = Custom[AutoRename](list=ꟿ_feet_tofraction_6)

# group: Main Doors
add_3 = autoRename_5 + autoRename_6
code_block_13 = CodeBlock { " "; }
string_3 = StringInput("")
replace_5 = String.Replace(string=add_3, searchFor=code_block_13, replaceWith=string_3)
code_block_14 = CodeBlock { 0; }
door_window_location_3 = CustomSelection("Secondary", items={Main: "Main - ", Secondary: "Secondary - ", Interior: ""})
insert_3 = String.Insert(string=replace_5, index=code_block_14, toInsert=door_window_location_3)

# group: Secondary Doors Rename
name_5 = Element.Name(element=filterByBoolMask.in)
replace_6 = String.Replace(string=name_5, searchFor=name_5, replaceWith=insert_3)
flatten_3 = List.Flatten(list=replace_6)
setName_3 = Custom[Element.SetName](element=filterByBoolMask.in, name=flatten_3)

# group: Category Rename
categories_2 = Categories("OST_Roofs")
all_families_of_category = Custom[All Families Of Category](category=categories_2)  # package Clockwork for Dynamo 2.x; Gets all famiies of a given category in the model (does *not *work for system families)
name_6 = Custom[Element.Name+](element=all_families_of_category)  # package Clockwork for Dynamo 2.x; Gets an element's name. Unlike the OOTB node, this node should work for *all* Revit elements that have names and will also return the localized names of system parameters, parameter groups, display unit types, parameter types, unit symbol types, unit types and ForgeTypeIds.
string_4 = StringInput("Roofs ")
contains = String.Contains(string=name_6, searchFor=string_4)
eq_3 = name_6 == contains
filterByBoolMask_3 = List.FilterByBoolMask(list=all_families_of_category, mask=eq_3)
name_7 = Element.Name(element=filterByBoolMask_3.in)
string_5 = StringInput("Basic Roof ")
replace_7 = String.Replace(string=name_7, searchFor=name_7, replaceWith=string_5)
indexOf = List.IndexOf(list=filterByBoolMask_3.in, element=filterByBoolMask_3.in)
code_block_15 = CodeBlock { 1; }
add_4 = indexOf + code_block_15
string_from_object = FromObject(object=add_4)
add_5 = replace_7 + string_from_object
replace_8 = String.Replace(string=name_7, searchFor=name_7, replaceWith=add_5)
setName_4 = Custom[Element.SetName](element=filterByBoolMask_3.in, name=replace_8)

# group: Windows Control
categories_3 = Categories("OST_Windows")
all_family_types_of_category_2 = Custom[All Family Types Of Category](category=categories_3)
name_8 = Element.Name(element=all_family_types_of_category_2)
length = String.Length(string=name_8)
code_block_16 = CodeBlock { 4; }
eq_4 = length == code_block_16
filterByBoolMask_4 = List.FilterByBoolMask(list=all_family_types_of_category_2, mask=eq_4)
name_9 = Element.Name(element=filterByBoolMask_4.out)
length_2 = String.Length(string=name_9)
code_block_17 = CodeBlock { 9; }
eq_5 = length_2 == code_block_17
filterByBoolMask_5 = List.FilterByBoolMask(list=filterByBoolMask_4.out, mask=eq_5)
name_10 = Element.Name(element=filterByBoolMask_5.out)
number_slider_11 = DoubleSlider(0, range=0..10 step 1)
number_slider_12 = DoubleSlider(4, range=0..10 step 1)
substring_3 = String.Substring(string=name_10, startIndex=number_slider_11, length=number_slider_12)
code_block_18 = CodeBlock { "Main"; }
eq_6 = substring_3 == code_block_18
filterByBoolMask_6 = List.FilterByBoolMask(list=filterByBoolMask_5.out, mask=eq_6)

# group: Width
code_block_19 = CodeBlock { "Width"; }
ʳʰʸᵗʰᵐ_elements_7 = Rhythm.Revit.Elements.Elements.GetParameterValueByNameTypeOrInstance(element=filterByBoolMask_6.out, parameterName=code_block_19)
number_slider_13 = DoubleSlider(2, range=0..100 step 1)
round_7 = Math.Round(number=ʳʰʸᵗʰᵐ_elements_7, digits=number_slider_13)
ꟿ_feet_tofraction_7 = Custom[ꟿ Feet.ToFraction](number=round_7)
autoRename_7 = Custom[AutoRename](list=ꟿ_feet_tofraction_7)

# group: Height
code_block_20 = CodeBlock { "Height"; }
ʳʰʸᵗʰᵐ_elements_8 = Rhythm.Revit.Elements.Elements.GetParameterValueByNameTypeOrInstance(element=filterByBoolMask_6.out, parameterName=code_block_20)
number_slider_14 = DoubleSlider(2, range=0..100 step 1)
round_8 = Math.Round(number=ʳʰʸᵗʰᵐ_elements_8, digits=number_slider_14)
ꟿ_feet_tofraction_8 = Custom[ꟿ Feet.ToFraction](number=round_8)
autoRename_8 = Custom[AutoRename](list=ꟿ_feet_tofraction_8)

# group: Secondry Windows
add_6 = autoRename_7 + autoRename_8
code_block_21 = CodeBlock { " "; }
string_6 = StringInput("")
replace_9 = String.Replace(string=add_6, searchFor=code_block_21, replaceWith=string_6)
code_block_22 = CodeBlock { 0; }
door_window_location_4 = CustomSelection("Secondary", items={Main: "Main - ", Secondary: "Secondary - ", Interior: ""})
insert_4 = String.Insert(string=replace_9, index=code_block_22, toInsert=door_window_location_4)

# group: Secondary Windows Rename
name_11 = Element.Name(element=filterByBoolMask_6.out)
replace_10 = String.Replace(string=name_11, searchFor=name_11, replaceWith=insert_4)
flatten_4 = List.Flatten(list=replace_10)
setName_5 = Custom[Element.SetName](element=filterByBoolMask_6.out, name=flatten_4)

# group: Type Rename
categories_4 = Categories("OST_Ceilings")
all_family_types_of_category_3 = Custom[All Family Types Of Category](category=categories_4)
name_12 = Custom[Element.Name+](element=all_family_types_of_category_3)
string_7 = StringInput("Ceilings")
contains_2 = String.Contains(string=name_12, searchFor=string_7)
eq_7 = name_12 == contains_2
filterByBoolMask_7 = List.FilterByBoolMask(list=all_family_types_of_category_3, mask=eq_7)
name_13 = Element.Name(element=filterByBoolMask_7.in)
string_8 = StringInput("WTS_Interior_Ceiling ")
replace_11 = String.Replace(string=name_13, searchFor=name_13, replaceWith=string_8)
setName_6 = Custom[Element.SetName](element=filterByBoolMask_7.in, name=replace_11)

# group: Category Rename
categories_5 = Categories("OST_Ceilings")
all_families_of_category_2 = Custom[All Families Of Category](category=categories_5)
name_14 = Custom[Element.Name+](element=all_families_of_category_2)
string_9 = StringInput("Ceilings")
contains_3 = String.Contains(string=name_14, searchFor=string_9)
eq_8 = name_14 == contains_3
filterByBoolMask_8 = List.FilterByBoolMask(list=all_families_of_category_2, mask=eq_8)
name_15 = Element.Name(element=filterByBoolMask_8.in)
string_10 = StringInput("Compound Ceiling Cut")
replace_12 = String.Replace(string=name_15, searchFor=name_15, replaceWith=string_10)
code_block_23 = CodeBlock { " "; }
indexOf_2 = List.IndexOf(list=filterByBoolMask_8.in, element=filterByBoolMask_8.in)
string_from_object_2 = FromObject(object=indexOf_2)
string_11 = StringInput("0")
string_12 = StringInput("")
replace_13 = String.Replace(string=string_from_object_2, searchFor=string_11, replaceWith=string_12)
add_7 = code_block_23 + replace_13
add_8 = replace_12 + add_7
replace_14 = String.Replace(string=name_15, searchFor=name_15, replaceWith=add_8)
trimTrailingWhitespace = String.TrimTrailingWhitespace(string=replace_14)
setName_7 = Custom[Element.SetName](element=filterByBoolMask_8.in, name=trimTrailingWhitespace)

# group: Width
code_block_24 = CodeBlock { "Width"; }
ʳʰʸᵗʰᵐ_elements_9 = Rhythm.Revit.Elements.Elements.GetParameterValueByNameTypeOrInstance(element=filterByBoolMask_6.in, parameterName=code_block_24)
number_slider_15 = DoubleSlider(2, range=0..100 step 1)
round_9 = Math.Round(number=ʳʰʸᵗʰᵐ_elements_9, digits=number_slider_15)
ꟿ_feet_tofraction_9 = Custom[ꟿ Feet.ToFraction](number=round_9)
autoRename_9 = Custom[AutoRename](list=ꟿ_feet_tofraction_9)

# group: Height
code_block_25 = CodeBlock { "Height"; }
ʳʰʸᵗʰᵐ_elements_10 = Rhythm.Revit.Elements.Elements.GetParameterValueByNameTypeOrInstance(element=filterByBoolMask_6.in, parameterName=code_block_25)
number_slider_16 = DoubleSlider(2, range=0..100 step 1)
round_10 = Math.Round(number=ʳʰʸᵗʰᵐ_elements_10, digits=number_slider_16)
ꟿ_feet_tofraction_10 = Custom[ꟿ Feet.ToFraction](number=round_10)
autoRename_10 = Custom[AutoRename](list=ꟿ_feet_tofraction_10)

# group: Main Windows
add_9 = autoRename_9 + autoRename_10
code_block_26 = CodeBlock { " "; }
string_13 = StringInput("")
replace_15 = String.Replace(string=add_9, searchFor=code_block_26, replaceWith=string_13)
code_block_27 = CodeBlock { 0; }
door_window_location_5 = CustomSelection("Main", items={Main: "Main - ", Secondary: "Secondary - ", Interior: ""})
insert_5 = String.Insert(string=replace_15, index=code_block_27, toInsert=door_window_location_5)

# group: Secondary Windows Rename
name_16 = Element.Name(element=filterByBoolMask_6.in)
replace_16 = String.Replace(string=name_16, searchFor=name_16, replaceWith=insert_5)
flatten_5 = List.Flatten(list=replace_16)
setName_8 = Custom[Element.SetName](element=filterByBoolMask_6.in, name=flatten_5)

# group: Type Rename
categories_6 = Categories("OST_Ceilings")
all_family_types_of_category_4 = Custom[All Family Types Of Category](category=categories_6)
name_17 = Custom[Element.Name+](element=all_family_types_of_category_4)
string_14 = StringInput("Ceilings")
contains_4 = String.Contains(string=name_17, searchFor=string_14)
eq_9 = name_17 == contains_4
filterByBoolMask_9 = List.FilterByBoolMask(list=all_family_types_of_category_4, mask=eq_9)
name_18 = Element.Name(element=filterByBoolMask_9.in)
string_15 = StringInput("WTS_Interior_Ceiling ")
replace_17 = String.Replace(string=name_18, searchFor=name_18, replaceWith=string_15)
setName_9 = Custom[Element.SetName](element=filterByBoolMask_9.in, name=replace_17)
name_19 = Element.Name(element=filterByBoolMask_9.out)
code_block_28 = CodeBlock { "Generic"; }
eq_10 = name_19 == code_block_28
filterByBoolMask_10 = List.FilterByBoolMask(list=filterByBoolMask_9.out, mask=eq_10)
name_20 = Element.Name(element=filterByBoolMask_10.out)
code_block_29 = CodeBlock { " "; }
code_block_30 = CodeBlock { "Thickness"; }
ʳʰʸᵗʰᵐ_elements_11 = Rhythm.Revit.Elements.Elements.GetParameterValueByNameTypeOrInstance(element=filterByBoolMask_10.out, parameterName=code_block_30)
ꟿ_feet_tofraction_11 = Custom[ꟿ Feet.ToFraction](number=ʳʰʸᵗʰᵐ_elements_11)
add_10 = code_block_29 + ꟿ_feet_tofraction_11
add_11 = name_20 + add_10
replace_18 = String.Replace(string=name_20, searchFor=name_20, replaceWith=add_11)
setName_10 = Custom[Element.SetName](element=filterByBoolMask_10.out, name=replace_18)

# group: Walls
categories_7 = Categories("OST_Walls")
all_family_types_of_category_5 = Custom[All Family Types Of Category](category=categories_7)
name_21 = Custom[Element.Name+](element=all_family_types_of_category_5)
string_16 = StringInput("Stone")
contains_5 = String.Contains(string=name_21, searchFor=string_16)
eq_11 = name_21 == contains_5
filterByBoolMask_11 = List.FilterByBoolMask(list=all_family_types_of_category_5, mask=eq_11)
name_22 = Custom[Element.Name+](element=filterByBoolMask_11.in)
string_17 = StringInput("Stone-Brick_1")
contains_6 = String.Contains(string=name_22, searchFor=string_17)
eq_12 = name_22 == contains_6
filterByBoolMask_12 = List.FilterByBoolMask(list=filterByBoolMask_11.in, mask=eq_12)

# group: Stone Switch
name_23 = Custom[Element.Name+](element=filterByBoolMask_12.out)
string_18 = StringInput("Stone-Brick_2")
contains_7 = String.Contains(string=name_23, searchFor=string_18)
eq_13 = name_23 == contains_7
filterByBoolMask_13 = List.FilterByBoolMask(list=filterByBoolMask_12.out, mask=eq_13)

# group: Stone Switch
name_24 = Custom[Element.Name+](element=filterByBoolMask_13.out)
string_19 = StringInput("Stone-Brick_3")
contains_8 = String.Contains(string=name_24, searchFor=string_19)
eq_14 = name_24 == contains_8
filterByBoolMask_14 = List.FilterByBoolMask(list=filterByBoolMask_13.out, mask=eq_14)

# group: Stone Switch
name_25 = Custom[Element.Name+](element=filterByBoolMask_14.out)
string_20 = StringInput("Stone-Brick_4")
contains_9 = String.Contains(string=name_25, searchFor=string_20)
eq_15 = name_25 == contains_9
filterByBoolMask_15 = List.FilterByBoolMask(list=filterByBoolMask_14.out, mask=eq_15)

# group: Interior Stone
name_26 = Element.Name(element=filterByBoolMask_15.out)
code_block_31 = CodeBlock { "Stone-Brick_Interior_1"; }
string_21 = StringInput(" - ")
code_block_32 = CodeBlock { "Width"; }
ʳʰʸᵗʰᵐ_elements_12 = Rhythm.Revit.Elements.Elements.GetParameterValueByNameTypeOrInstance(element=filterByBoolMask_15.out, parameterName=code_block_32)
ꟿ_feet_tofraction_12 = Custom[ꟿ Feet.ToFraction](number=ʳʰʸᵗʰᵐ_elements_12)
add_12 = string_21 + ꟿ_feet_tofraction_12
add_13 = code_block_31 + add_12
replace_19 = String.Replace(string=name_26, searchFor=name_26, replaceWith=add_13)
setName_11 = Custom[Element.SetName](element=filterByBoolMask_15.out, name=replace_19)

# group: Stone 4
name_27 = Element.Name(element=filterByBoolMask_15.in)
code_block_33 = CodeBlock { "Stone-Brick_4"; }
string_22 = StringInput(" - ")
code_block_34 = CodeBlock { "Width"; }
ʳʰʸᵗʰᵐ_elements_13 = Rhythm.Revit.Elements.Elements.GetParameterValueByNameTypeOrInstance(element=filterByBoolMask_15.in, parameterName=code_block_34)
ꟿ_feet_tofraction_13 = Custom[ꟿ Feet.ToFraction](number=ʳʰʸᵗʰᵐ_elements_13)
add_14 = string_22 + ꟿ_feet_tofraction_13
add_15 = code_block_33 + add_14
replace_20 = String.Replace(string=name_27, searchFor=name_27, replaceWith=add_15)
setName_12 = Custom[Element.SetName](element=filterByBoolMask_15.in, name=replace_20)

# group: Stone 3
name_28 = Element.Name(element=filterByBoolMask_14.in)
code_block_35 = CodeBlock { "Stone-Brick_3"; }
string_23 = StringInput(" - ")
code_block_36 = CodeBlock { "Width"; }
ʳʰʸᵗʰᵐ_elements_14 = Rhythm.Revit.Elements.Elements.GetParameterValueByNameTypeOrInstance(element=filterByBoolMask_14.in, parameterName=code_block_36)
ꟿ_feet_tofraction_14 = Custom[ꟿ Feet.ToFraction](number=ʳʰʸᵗʰᵐ_elements_14)
add_16 = string_23 + ꟿ_feet_tofraction_14
add_17 = code_block_35 + add_16
replace_21 = String.Replace(string=name_28, searchFor=name_28, replaceWith=add_17)
setName_13 = Custom[Element.SetName](element=filterByBoolMask_14.in, name=replace_21)

# group: Stone 2
name_29 = Element.Name(element=filterByBoolMask_13.in)
code_block_37 = CodeBlock { "Stone-Brick_2"; }
string_24 = StringInput(" - ")
code_block_38 = CodeBlock { "Width"; }
ʳʰʸᵗʰᵐ_elements_15 = Rhythm.Revit.Elements.Elements.GetParameterValueByNameTypeOrInstance(element=filterByBoolMask_13.in, parameterName=code_block_38)
ꟿ_feet_tofraction_15 = Custom[ꟿ Feet.ToFraction](number=ʳʰʸᵗʰᵐ_elements_15)
add_18 = string_24 + ꟿ_feet_tofraction_15
add_19 = code_block_37 + add_18
replace_22 = String.Replace(string=name_29, searchFor=name_29, replaceWith=add_19)
setName_14 = Custom[Element.SetName](element=filterByBoolMask_13.in, name=replace_22)

# group: Stone 1
name_30 = Element.Name(element=filterByBoolMask_12.in)
code_block_39 = CodeBlock { "Stone-Brick_1"; }
string_25 = StringInput(" - ")
code_block_40 = CodeBlock { "Width"; }
ʳʰʸᵗʰᵐ_elements_16 = Rhythm.Revit.Elements.Elements.GetParameterValueByNameTypeOrInstance(element=filterByBoolMask_12.in, parameterName=code_block_40)
ꟿ_feet_tofraction_16 = Custom[ꟿ Feet.ToFraction](number=ʳʰʸᵗʰᵐ_elements_16)
add_20 = string_25 + ꟿ_feet_tofraction_16
add_21 = code_block_39 + add_20
replace_23 = String.Replace(string=name_30, searchFor=name_30, replaceWith=add_21)
setName_15 = Custom[Element.SetName](element=filterByBoolMask_12.in, name=replace_23)
