# Dynamo graph Auto Rename.dyn (Dynamo 2.16.2.5624)
# author: Yousef Altear
# packages: Rhythm 2023.9.1, archi-lab.net 2024.217.1024, spring nodes 210.1.1, Clockwork for Dynamo 2.x 2.6.0, bimorphNodes 5.1.3

select_model_elements = DSModelElementsSelection()  # 1 picked in the model; graph input

# group: Family Data
parameters = Element.Parameters(element=select_model_elements)
watch = Watch(parameters)
type = archilab.Revit.Elements.Elements.Type(element=select_model_elements)
parameters_2 = Element.Parameters(element=type)
watch_2 = Watch(parameters_2)

custom_selection = CustomSelection("Windows", items={Windows: "Windows", Door: "Doors"})
byName = Category.ByName(name=custom_selection)
# note: Ⓒ Copyright of Script to Paragons Egypt Team
ꟿ_collect_allelementsof = Custom[ꟿ Collect.AllElementsOf](CategoryOrType=byName)  # package spring nodes; Works with either categories or types and uses multi-filters to get multiple groups with a single query. Can be applied as a function. No ties to the Document.Changed event.

# group: Windows Control
categories = Categories("OST_Windows")
all_family_types_of_category = Custom[All Family Types Of Category](category=categories)  # package Clockwork for Dynamo 2.x; Gets all family types/symbols of a given category in the model.
name = Element.Name(element=all_family_types_of_category)
number_slider = DoubleSlider(0, range=0..10 step 1)
number_slider_2 = DoubleSlider(4, range=0..10 step 1)
substring = String.Substring(string=name, startIndex=number_slider, length=number_slider_2)
code_block = CodeBlock { "Main"; }
eq = substring == code_block
filterByBoolMask = List.FilterByBoolMask(list=all_family_types_of_category, mask=eq)

# group: Main Windows Data
code_block_2 = CodeBlock { "Width"; }
ʳʰʸᵗʰᵐ_elements = Rhythm.Revit.Elements.Elements.GetParameterValueByNameTypeOrInstance(element=filterByBoolMask.in, parameterName=code_block_2)
ꟿ_feet_tofraction = Custom[ꟿ Feet.ToFraction](number=ʳʰʸᵗʰᵐ_elements, lacing=Longest)  # package spring nodes; Converts a decimal foot value to a fractional foot/inch string.
string = StringInput("/256\"")
string_2 = StringInput(" ")
replace = String.Replace(string=ꟿ_feet_tofraction, searchFor=string, replaceWith=string_2)
string_3 = StringInput("'")
replace_2 = String.Replace(string=replace, searchFor=string_3, replaceWith=string_2)
number_slider_3 = DoubleSlider(0, range=0..10 step 1)
number_slider_4 = DoubleSlider(4, range=0..10 step 1)
substring_2 = String.Substring(string=replace_2, startIndex=number_slider_3, length=number_slider_4)
number = DoubleInput(1)
chop = List.Chop(list=substring_2, lengths=number, lacing=Longest)
code_block_3 = CodeBlock { "Height"; }
ʳʰʸᵗʰᵐ_elements_2 = Rhythm.Revit.Elements.Elements.GetParameterValueByNameTypeOrInstance(element=filterByBoolMask.in, parameterName=code_block_3)
ꟿ_feet_tofraction_2 = Custom[ꟿ Feet.ToFraction](number=ʳʰʸᵗʰᵐ_elements_2, lacing=Longest)
string_4 = StringInput("/256\"")
string_5 = StringInput(" ")
replace_3 = String.Replace(string=ꟿ_feet_tofraction_2, searchFor=string_4, replaceWith=string_5)
string_6 = StringInput("'")
replace_4 = String.Replace(string=replace_3, searchFor=string_6, replaceWith=string_5)
number_slider_5 = DoubleSlider(0, range=0..10 step 1)
number_slider_6 = DoubleSlider(4, range=0..10 step 1)
substring_3 = String.Substring(string=replace_4, startIndex=number_slider_5, length=number_slider_6)
number_2 = DoubleInput(1)
chop_2 = List.Chop(list=substring_3, lengths=number_2, lacing=Longest)
add = chop + chop_2
code_block_4 = CodeBlock { " "; }
string_7 = StringInput("")
replace_5 = String.Replace(string=add, searchFor=code_block_4, replaceWith=string_7)
code_block_5 = CodeBlock { 0; }
door_window_location = CustomSelection("Main", items={Main: "Main - ", Secoundry: "Secondary - ", Interior: ""})

insert = String.Insert(string=replace_5, index=code_block_5, toInsert=door_window_location)
string_from_object = FromObject(object=select_model_elements)
categories_2 = Categories("OST_Windows")
all_family_types_of_category_2 = Custom[All Family Types Of Category](category=categories_2)
name_2 = Element.Name(element=all_family_types_of_category_2)
code_block_6 = CodeBlock { "xxx"; }
code_block_7 = CodeBlock { "44343"; }
replace_6 = String.Replace(string=name_2, searchFor=code_block_6, replaceWith=code_block_7)
setName = Custom[Element.SetName](element=all_family_types_of_category_2, name=replace_6)  # package Clockwork for Dynamo 2.x; Gets the name of a given Revit element
watch_3 = Watch(setName.success)
watch_4 = Watch(setName.element)
select_model_element = DSModelElementSelection()  # nothing selected
elementType = Revit.LinkElement.ElementType(linkElement=select_model_element)
code_block_8 = CodeBlock { "Walls"; }
byName_2 = Category.ByName(name=code_block_8)
ꟿ_collect_allelementsof_2 = Custom[ꟿ Collect.AllElementsOf](CategoryOrType=byName_2)
name_3 = Element.Name(element=ꟿ_collect_allelementsof_2)
code_block_9 = CodeBlock { "Ext"; }
contains = String.Contains(string=name_3, searchFor=code_block_9)
filterByBoolMask_2 = List.FilterByBoolMask(list=ꟿ_collect_allelementsof_2, mask=contains)
name_4 = Element.Name(element=filterByBoolMask_2.in)
code_block_10 = CodeBlock { "xxx"; }
replace_7 = String.Replace(string=name_4, searchFor=code_block_9, replaceWith=code_block_10)
setName_2 = Custom[Element.SetName](element=filterByBoolMask_2.in, name=replace_7)
watch_5 = Watch(setName_2.success)
custom_selection_2 = CustomSelection("Windows", items={Windows: "Windows", Door: "Doors"})
watch_6 = Watch(setName_2.element)

# group: Secoundry Windows Data
code_block_11 = CodeBlock { "Width"; }
ʳʰʸᵗʰᵐ_elements_3 = Rhythm.Revit.Elements.Elements.GetParameterValueByNameTypeOrInstance(element=filterByBoolMask.out, parameterName=code_block_11)
ꟿ_feet_tofraction_3 = Custom[ꟿ Feet.ToFraction](number=ʳʰʸᵗʰᵐ_elements_3, lacing=Longest)
string_8 = StringInput("/256\"")
string_9 = StringInput(" ")
replace_8 = String.Replace(string=ꟿ_feet_tofraction_3, searchFor=string_8, replaceWith=string_9)
string_10 = StringInput("'")
replace_9 = String.Replace(string=replace_8, searchFor=string_10, replaceWith=string_9)
number_slider_7 = DoubleSlider(0, range=0..10 step 1)
number_slider_8 = DoubleSlider(4, range=0..10 step 1)
substring_4 = String.Substring(string=replace_9, startIndex=number_slider_7, length=number_slider_8)
number_3 = DoubleInput(1)
chop_3 = List.Chop(list=substring_4, lengths=number_3, lacing=Longest)
code_block_12 = CodeBlock { "Height"; }
ʳʰʸᵗʰᵐ_elements_4 = Rhythm.Revit.Elements.Elements.GetParameterValueByNameTypeOrInstance(element=filterByBoolMask.out, parameterName=code_block_12)
ꟿ_feet_tofraction_4 = Custom[ꟿ Feet.ToFraction](number=ʳʰʸᵗʰᵐ_elements_4, lacing=Longest)
string_11 = StringInput("/256\"")
string_12 = StringInput(" ")
replace_10 = String.Replace(string=ꟿ_feet_tofraction_4, searchFor=string_11, replaceWith=string_12)
string_13 = StringInput("'")
replace_11 = String.Replace(string=replace_10, searchFor=string_13, replaceWith=string_12)
number_slider_9 = DoubleSlider(0, range=0..10 step 1)
number_slider_10 = DoubleSlider(4, range=0..10 step 1)
substring_5 = String.Substring(string=replace_11, startIndex=number_slider_9, length=number_slider_10)
number_4 = DoubleInput(1)
chop_4 = List.Chop(list=substring_5, lengths=number_4, lacing=Longest)
add_2 = chop_3 + chop_4
code_block_13 = CodeBlock { " "; }
string_14 = StringInput("")
replace_12 = String.Replace(string=add_2, searchFor=code_block_13, replaceWith=string_14)
code_block_14 = CodeBlock { 0; }
door_window_location_2 = CustomSelection("Secoundry", items={Main: "Main - ", Secoundry: "Secondary - ", Interior: ""})

insert_2 = String.Insert(string=replace_12, index=code_block_14, toInsert=door_window_location_2)

# group: Door Control
categories_3 = Categories("OST_Doors")
all_family_types_of_category_3 = Custom[All Family Types Of Category](category=categories_3)
name_5 = Element.Name(element=all_family_types_of_category_3)
number_slider_11 = DoubleSlider(0, range=0..10 step 1)
number_slider_12 = DoubleSlider(4, range=0..10 step 1)
substring_6 = String.Substring(string=name_5, startIndex=number_slider_11, length=number_slider_12)
code_block_15 = CodeBlock { "Main"; }
eq_2 = substring_6 == code_block_15
filterByBoolMask_3 = List.FilterByBoolMask(list=all_family_types_of_category_3, mask=eq_2)
name_6 = Element.Name(element=filterByBoolMask_3.out)
number_slider_13 = DoubleSlider(0, range=0..10 step 1)
number_slider_14 = DoubleSlider(4, range=0..10 step 1)
substring_7 = String.Substring(string=name_6, startIndex=number_slider_13, length=number_slider_14)
code_block_16 = CodeBlock { "Seco"; }
eq_3 = substring_7 == code_block_16
filterByBoolMask_4 = List.FilterByBoolMask(list=filterByBoolMask_3.out, mask=eq_3)

# group: Secoundry Door Data
code_block_17 = CodeBlock { "Width"; }
ʳʰʸᵗʰᵐ_elements_5 = Rhythm.Revit.Elements.Elements.GetParameterValueByNameTypeOrInstance(element=filterByBoolMask_4.in, parameterName=code_block_17)
watch_7 = Watch(ʳʰʸᵗʰᵐ_elements_5)
ꟿ_feet_tofraction_5 = Custom[ꟿ Feet.ToFraction](number=watch_7, lacing=Longest)
string_15 = StringInput("/256\"")
string_16 = StringInput(" ")
replace_13 = String.Replace(string=ꟿ_feet_tofraction_5, searchFor=string_15, replaceWith=string_16)
string_17 = StringInput("'")
replace_14 = String.Replace(string=replace_13, searchFor=string_17, replaceWith=string_16)
number_slider_15 = DoubleSlider(0, range=0..10 step 1)
number_slider_16 = DoubleSlider(4, range=0..10 step 1)
substring_8 = String.Substring(string=replace_14, startIndex=number_slider_15, length=number_slider_16)
number_5 = DoubleInput(1)
chop_5 = List.Chop(list=substring_8, lengths=number_5, lacing=Longest)
code_block_18 = CodeBlock { "Height"; }
ʳʰʸᵗʰᵐ_elements_6 = Rhythm.Revit.Elements.Elements.GetParameterValueByNameTypeOrInstance(element=filterByBoolMask_4.in, parameterName=code_block_18)
watch_8 = Watch(ʳʰʸᵗʰᵐ_elements_6)
ꟿ_feet_tofraction_6 = Custom[ꟿ Feet.ToFraction](number=watch_8, lacing=Longest)
string_18 = StringInput("/256\"")
string_19 = StringInput(" ")
replace_15 = String.Replace(string=ꟿ_feet_tofraction_6, searchFor=string_18, replaceWith=string_19)
string_20 = StringInput("'")
replace_16 = String.Replace(string=replace_15, searchFor=string_20, replaceWith=string_19)
number_slider_17 = DoubleSlider(0, range=0..10 step 1)
number_slider_18 = DoubleSlider(4, range=0..10 step 1)
substring_9 = String.Substring(string=replace_16, startIndex=number_slider_17, length=number_slider_18)
number_6 = DoubleInput(1)
chop_6 = List.Chop(list=substring_9, lengths=number_6, lacing=Longest)
add_3 = chop_5 + chop_6
code_block_19 = CodeBlock { " "; }
string_21 = StringInput("")
replace_17 = String.Replace(string=add_3, searchFor=code_block_19, replaceWith=string_21)
code_block_20 = CodeBlock { 0; }
door_window_location_3 = CustomSelection("Secoundry", items={Main: "Main - ", Secoundry: "Secondary - ", Interior: ""})

insert_3 = String.Insert(string=replace_17, index=code_block_20, toInsert=door_window_location_3)

# group: Main Door Data
code_block_21 = CodeBlock { "Width"; }
ʳʰʸᵗʰᵐ_elements_7 = Rhythm.Revit.Elements.Elements.GetParameterValueByNameTypeOrInstance(element=filterByBoolMask_3.in, parameterName=code_block_21)
ꟿ_feet_tofraction_7 = Custom[ꟿ Feet.ToFraction](number=ʳʰʸᵗʰᵐ_elements_7, lacing=Longest)
string_22 = StringInput("/256\"")
string_23 = StringInput(" ")
replace_18 = String.Replace(string=ꟿ_feet_tofraction_7, searchFor=string_22, replaceWith=string_23)
string_24 = StringInput("'")
replace_19 = String.Replace(string=replace_18, searchFor=string_24, replaceWith=string_23)
number_slider_19 = DoubleSlider(0, range=0..10 step 1)
number_slider_20 = DoubleSlider(4, range=0..10 step 1)
substring_10 = String.Substring(string=replace_19, startIndex=number_slider_19, length=number_slider_20)
number_7 = DoubleInput(1)
chop_7 = List.Chop(list=substring_10, lengths=number_7, lacing=Longest)
code_block_22 = CodeBlock { "Height"; }
ʳʰʸᵗʰᵐ_elements_8 = Rhythm.Revit.Elements.Elements.GetParameterValueByNameTypeOrInstance(element=filterByBoolMask_3.in, parameterName=code_block_22)
ꟿ_feet_tofraction_8 = Custom[ꟿ Feet.ToFraction](number=ʳʰʸᵗʰᵐ_elements_8, lacing=Longest)
string_25 = StringInput("/256\"")
string_26 = StringInput(" ")
replace_20 = String.Replace(string=ꟿ_feet_tofraction_8, searchFor=string_25, replaceWith=string_26)
string_27 = StringInput("'")
replace_21 = String.Replace(string=replace_20, searchFor=string_27, replaceWith=string_26)
number_slider_21 = DoubleSlider(0, range=0..10 step 1)
number_slider_22 = DoubleSlider(4, range=0..10 step 1)
substring_11 = String.Substring(string=replace_21, startIndex=number_slider_21, length=number_slider_22)
number_8 = DoubleInput(1)
chop_8 = List.Chop(list=substring_11, lengths=number_8, lacing=Longest)
add_4 = chop_7 + chop_8
code_block_23 = CodeBlock { " "; }
string_28 = StringInput("")
replace_22 = String.Replace(string=add_4, searchFor=code_block_23, replaceWith=string_28)
code_block_24 = CodeBlock { 0; }
door_window_location_4 = CustomSelection("Main", items={Main: "Main - ", Secoundry: "Secondary - ", Interior: ""})

insert_4 = String.Insert(string=replace_22, index=code_block_24, toInsert=door_window_location_4)

# group: Interior Door Data
code_block_25 = CodeBlock { "Width"; }
ʳʰʸᵗʰᵐ_elements_9 = Rhythm.Revit.Elements.Elements.GetParameterValueByNameTypeOrInstance(element=filterByBoolMask_4.out, parameterName=code_block_25)
ꟿ_feet_tofraction_9 = Custom[ꟿ Feet.ToFraction](number=ʳʰʸᵗʰᵐ_elements_9, lacing=Longest)
string_29 = StringInput("/256\"")
string_30 = StringInput(" ")
replace_23 = String.Replace(string=ꟿ_feet_tofraction_9, searchFor=string_29, replaceWith=string_30)
string_31 = StringInput("'")
replace_24 = String.Replace(string=replace_23, searchFor=string_31, replaceWith=string_30)
number_slider_23 = DoubleSlider(0, range=0..10 step 1)
number_slider_24 = DoubleSlider(4, range=0..10 step 1)
substring_12 = String.Substring(string=replace_24, startIndex=number_slider_23, length=number_slider_24)
number_9 = DoubleInput(1)
chop_9 = List.Chop(list=substring_12, lengths=number_9, lacing=Longest)
code_block_26 = CodeBlock { "Height"; }
ʳʰʸᵗʰᵐ_elements_10 = Rhythm.Revit.Elements.Elements.GetParameterValueByNameTypeOrInstance(element=filterByBoolMask_4.out, parameterName=code_block_26)
ꟿ_feet_tofraction_10 = Custom[ꟿ Feet.ToFraction](number=ʳʰʸᵗʰᵐ_elements_10, lacing=Longest)
string_32 = StringInput("/256\"")
string_33 = StringInput(" ")
replace_25 = String.Replace(string=ꟿ_feet_tofraction_10, searchFor=string_32, replaceWith=string_33)
string_34 = StringInput("'")
replace_26 = String.Replace(string=replace_25, searchFor=string_34, replaceWith=string_33)
number_slider_25 = DoubleSlider(0, range=0..10 step 1)
number_slider_26 = DoubleSlider(4, range=0..10 step 1)
substring_13 = String.Substring(string=replace_26, startIndex=number_slider_25, length=number_slider_26)
number_10 = DoubleInput(1)
chop_10 = List.Chop(list=substring_13, lengths=number_10, lacing=Longest)
add_5 = chop_9 + chop_10
code_block_27 = CodeBlock { " "; }
string_35 = StringInput("")
replace_27 = String.Replace(string=add_5, searchFor=code_block_27, replaceWith=string_35)
code_block_28 = CodeBlock { 0; }
door_window_location_5 = CustomSelection("Interior", items={Main: "Main - ", Secoundry: "Secondary - ", Interior: ""})

insert_5 = String.Insert(string=replace_27, index=code_block_28, toInsert=door_window_location_5)
